# Dynamo graph 00-base.dyn (Dynamo 0.9.1.4062)

string = StringInput("C:\Users\danil\Documents\GitHub\space-syntax\00-base files\king_5.obj")
importFile = Autodesk.Dynamo.MeshToolkitR2.Mesh.ImportFile(string)
string_2 = StringInput("C:\Users\danil\Documents\GitHub\space-syntax\00-base files\points_5.json")
readText = File.ReadText(string_2)
python_script = Python(IN[0]=readText)
# ---------- python_script.python (24 lines) ----------
import clr

import sys
sys.path.append('C:\Program Files (x86)\IronPython 2.7\Lib') 

clr.AddReference('ProtoGeometry')
from Autodesk.DesignScript.Geometry import *
#The inputs to this node will be stored as a list in the IN variables.
dataEnteringNode = IN

import json

pts_data = json.loads(IN[0])

pts = []



for key in pts_data.keys():
	pt = pts_data[key]
	pts.append(Point.ByCoordinates(pt[0], pt[1], pt[2]))

#Assign your output to the OUT variable.
OUT = pts
# ----------------------------------------
string_3 = StringInput("C:\Users\danil\Documents\GitHub\space-syntax\00-base files\toronto_data_160218_manDiv.json")
readText_2 = File.ReadText(string_3)
python_script_2 = Python(IN[0]=readText, IN[1]=readText_2)
# ---------- python_script_2.python (44 lines) ----------
import clr

import sys
sys.path.append('C:\Program Files (x86)\IronPython 2.7\Lib') 

clr.AddReference('ProtoGeometry')
from Autodesk.DesignScript.Geometry import *
#The inputs to this node will be stored as a list in the IN variables.
dataEnteringNode = IN

import json

pts_data = json.loads(IN[0])

lines = []
	
	

employee_data = json.loads(IN[1])

ids_survey = [x["_id"] for x in employee_data["employees"]]

for key in pts_data.keys():

	pt1_coords = pts_data[key]
	
	pt1 = Point.ByCoordinates(pt1_coords[0], pt1_coords[1], pt1_coords[2])

	neighbors = employee_data["employees"][ids_survey.index(int(key))]["neighbor_id"]

	for neighbor in neighbors:
		try:
			pt2_coords = pts_data[str(neighbor)]
			pt2 = Point.ByCoordinates(pt2_coords[0], pt2_coords[1], pt2_coords[2])
			lines.append(Line.ByStartPointEndPoint(pt1, pt2))
		except KeyError:
			pass
			




#Assign your output to the OUT variable.
OUT = lines
# ----------------------------------------
