# Dynamo graph 210King-visibility-graph.dyn (Dynamo 0.9.1.4054)

file_path = Filename("C:\Users\tyson\Dropbox\ramtin_floor5_nomat.obj")
importFile = Autodesk.Dynamo.MeshToolkitR2.Mesh.ImportFile(file_path)
number = DoubleInput(1)
byCoordinates = Vector.ByCoordinates(x=number)
number_2 = DoubleInput(90)
rotate = Autodesk.Dynamo.MeshToolkitR2.Mesh.Rotate(importFile, byCoordinates, number_2)
number_3 = DoubleInput(0.1)
scale = Autodesk.Dynamo.MeshToolkitR2.Mesh.Scale(rotate, number_3)
number_4 = DoubleInput(20)
number_5 = DoubleInput(-190)
translate = Autodesk.Dynamo.MeshToolkitR2.Mesh.Translate(scale, number_4, arg3=number_5)
number_6 = DoubleInput(25)
number_7 = DoubleInput(45)
ray_origin = Point.ByCoordinates(x=number_6, y=number_7)
number_8 = DoubleInput(25)
number_9 = DoubleInput(125)
ray_origin_2 = Point.ByCoordinates(x=number_8, y=number_9)
segmentIntersects = Autodesk.Dynamo.MeshToolkitR2.Mesh.SegmentIntersects(translate, ray_origin, ray_origin_2)
code_block = CodeBlock { 170; }
code_block_2 = CodeBlock { 10; }
code_block_3 = CodeBlock { 200; }
code_block_4 = CodeBlock { 10; }
code_block_5 = CodeBlock(X=code_block, Nx=code_block_2, Y=code_block_3, Ny=code_block_4) { (-120-X)..(-120+X)..#Nx; -Y..Y..#Ny; }
grid_points = Point.ByCoordinates(x=code_block_5.out0, y=code_block_5.out1, lacing=CrossProduct)
code_block_6 = CodeBlock { 1; }
flatten = List.Flatten(list=grid_points, amt=code_block_6)
flatten_2 = List.Flatten(list=grid_points, amt=code_block_6)
byStartPointEndPoint = Line.ByStartPointEndPoint(startPoint=flatten, endPoint=flatten_2, lacing=CrossProduct)
flatten_3 = List.Flatten(list=byStartPointEndPoint, amt=code_block_6)
segmentIntersects_2 = Autodesk.Dynamo.MeshToolkitR2.Mesh.SegmentIntersects(translate)
flatten_4 = List.Flatten(list=grid_points, amt=code_block_6)
cartesianProduct = List.CartesianProduct(segmentIntersects_2, flatten_4, flatten_4)
code_block_7 = CodeBlock { 2; }
flatten_5 = List.Flatten(list=cartesianProduct, amt=code_block_7)
not_ = Not(flatten_5)
filterByBoolMask = List.FilterByBoolMask(list=flatten_3, mask=not_)
create = List.Create(filterByBoolMask.in)
code_block_8 = CodeBlock { true; }
