# Dynamo graph isovist_90_p.dyn (Dynamo 0.9.0.3067)

string = StringInput("C:\Users\damon\Documents\GitHub\space-syntax\ISOVIST\model_mesh.obj")
importFile = Autodesk.Dynamo.MeshToolkitR2.Mesh.ImportFile(string)
string_2 = StringInput("C:\Users\damon\Documents\GitHub\space-syntax\ISOVIST\outputSolid.csv")
importFromCSV = ImportFromCSV(string_2)
transpose = List.Transpose(importFromCSV)
python_script = Python(IN[0]=transpose)
# ---------- python_script.python (17 lines) ----------
import clr
clr.AddReference('ProtoGeometry')
from Autodesk.DesignScript.Geometry import *
#The inputs to this node will be stored as a list in the IN variables.
dataEnteringNode = IN

x = IN[0]

ws = []

for i in x:
	if i[5] < 3.1:
		unit = [i[0],i[1],i[2],i[3],i[4],i[5],i[6]]
		ws.append(unit)

#Assign your output to the OUT variable.
OUT = ws
# ----------------------------------------
transpose_2 = List.Transpose(python_script)
code_block = CodeBlock(x=transpose_2) { x[0]; x[1]; x[2]; x[3]; x[4]; x[5]; x[6]; }
python_script_2 = Python(IN[0]=code_block.out6)
# ---------- python_script_2.python (20 lines) ----------
import clr
clr.AddReference('ProtoGeometry')
from Autodesk.DesignScript.Geometry import *
#The inputs to this node will be stored as a list in the IN variables.
dataEnteringNode = IN

deg = IN[0]

vec = []

for i in deg:
	if i == 0:
		vec.append(Vector.ByCoordinates(-1,0,0))
	if i == 90:
		vec.append(Vector.ByCoordinates(0,-1,0))
	if i == 180:
		vec.append(Vector.ByCoordinates(1,0,0))

#Assign your output to the OUT variable.
OUT = vec
# ----------------------------------------
code_block_2 = CodeBlock(x=code_block.out0, y=code_block.out1, z=code_block.out2, r=python_script_2) { point1 = Autodesk.Point.ByCoordinates(x-1, y, z+3); r; }
code_block_3 = CodeBlock { vector1 = Vector.ZAxis(); t1 = 120; 60; }
generateIsovist = Autodesk.Dynamo.MeshToolkitR2.Mesh.GenerateIsovist(importFile, code_block_2.point1, code_block_2.r, code_block_3.vector1, code_block_3.t1, code_block_3.out2, lacing=Longest)
removeNulls = Lists.Manage.RemoveNulls(generateIsovist)
code_block_4 = CodeBlock(x=removeNulls) { x; }
vertices = Autodesk.Dynamo.MeshToolkitR2.Mesh.Vertices(code_block_4)
byPoints = Polygon.ByPoints(vertices)
code_block_5 = CodeBlock { 255; 255; 0; }
byARGB = Color.ByARGB(a=code_block_5.out0, r=code_block_5.out1, g=code_block_5.out2, b=code_block_5.out2)
byGeometryColor = Display.Display.ByGeometryColor(byPoints, byARGB)
string_3 = StringInput("C:\test\mars_workflow\data\outputsDYN-IsoVist.csv")
python_script_3 = Python(IN[0]=string_3)
# ---------- python_script_3.python (8 lines) ----------
import clr
clr.AddReference('ProtoGeometry')
from Autodesk.DesignScript.Geometry import *
#The inputs to this node will be stored as a list in the IN variables.
dataEnteringNode = IN

#Assign your output to the OUT variable.
OUT = IN[0]
# ----------------------------------------
code_block_6 = CodeBlock { 1; 20; }
byPatch = Surface.ByPatch(byPoints)
work_stations = CodeBlock(p=code_block_2.point1) { p; }
transpose_3 = List.Transpose(vertices)
start_point = CodeBlock(x=transpose_3) { x[0]; }
number_slider = DoubleSlider(75, range=0..100 step 0.1)
python_script_4 = Python(IN[0]=byPatch, IN[1]=work_stations, IN[2]=start_point, IN[3]=number_slider)
# ---------- python_script_4.python (44 lines) ----------
import clr
import sys

sys.path.append('C:\Program Files (x86)\IronPython 2.7\Lib')

import json
from multiprocessing import Pool

clr.AddReference('ProtoGeometry')
from Autodesk.DesignScript.Geometry import *


isoVist = IN[0]
point = IN[1]
eyePoint = IN[2]
limit = IN[3]

intersects = []
intersectsRange = []

c = 0
for i in isoVist:
	unit = []
	in_view = 0
	for j in point:
		
		if Geometry.DoesIntersect(i,j):
			d = Geometry.DistanceTo(eyePoint[c],j)
			unit.append(d)
			if d < limit:
				in_view+=1
		else:
			pass
	
	if in_view > 20:
		in_view = 20
	
	intersects.append(in_view)
	intersectsRange.append(unit)
	
	c+=1

#Assign your output to the OUT variable.
OUT = intersects, intersectsRange
# ----------------------------------------
num_ppl_in_view = CodeBlock(x=python_script_4) { x[0]; }
map = Map(code_block_6.out0, code_block_6.out1, num_ppl_in_view)
code_block_7 = CodeBlock(x=map) { a=10-x*10; b=Sum(a)/Count(x); }
output_isovist = Watch(code_block_7.b)
writeToFile = CSV.WriteToFile(python_script_3, output_isovist)
python_script_5 = Python(IN[0]=code_block_2.point1, IN[1]=code_block_2.r)
# ---------- python_script_5.python (27 lines) ----------
import clr
clr.AddReference('ProtoGeometry')
from Autodesk.DesignScript.Geometry import *
#The inputs to this node will be stored as a list in the IN variables.
dataEnteringNode = IN

p = IN[0]
r = IN[1]

f2m = []
f2 = [] 
r2m = []
r2 = [] 

c = 0
for i in p:

	if i.Z > 7.5:
		f2m.append(i)
		r2m.append(r[c])
	else:
		f2.append(i)
		r2.append(r[c])
	c+=1
	
#Assign your output to the OUT variable.
OUT = f2m,f2,r2m,r2
# ----------------------------------------
num_of_ppl_in_view = Watch(num_ppl_in_view)
watch = Watch(code_block_7.a)
distance_to_ppl = CodeBlock(x=python_script_4) { x[1]; }
distance_to_ppl_2 = Watch(distance_to_ppl)
code_block_8 = CodeBlock(x=byPatch) { x[177]; }
code_block_9 = CodeBlock(x=start_point) { x[177]; }
code_block_10 = CodeBlock(x=map) { a=x*10; b=Sum(a)/Count(x); }
watch_2 = Watch(code_block_10.a)
