# Grasshopper definition viz_graph_adjacency.gh (Grasshopper 0.9.76)
# plug-ins: TTToolbox, Python Interpreter, SonicBranchCount, Kangaroo Components, HDTReference, Shortest Walk in Gh, karamba

panel = Panel("import json data")

# ---- group: toronto json
path = FilePath("E:\lorenzo_temporary\MaRS\ScoringMaRS\toronto_data_160218_manDiv.json")

# ----
panel_2 = Panel(path)

# ---- group: amenity json
path_2 = FilePath("E:\lorenzo_temporary\MaRS\ScoringMaRS\amenity_data_160203.json")

# ---- group: Search Depth
# import geometry by layer and branch items by floor
number_slider = Slider(2, range=1..10)

# ----
pipeline = GeometryPipeline(
    GroupByLayer=False,
    GroupByType=False,
    IncludeHidden=True,
    IncludeLocked=True,
    LayerFilter="wall-ext",
    NameFilter="*",
    TypeFilter=4)

# ---- group: Sample Density (ft)
panel_3 = Panel("50")

# ---- group: column geo
geo = Geometry(pipeline)

# ----
curvepoint = PointOnCurve(geo, parameter=0.5)
pt = Point(curvepoint)
pt_2 = Point(pt)
pdecon = Deconstruct(Point=pt_2)  # -> XComponent, YComponent, ZComponent
sort = SortList(Keys=pdecon.ZComponent)  # -> Keys, ValuesA
dcon = DeleteConsecutive(Set=sort.Keys, Wrap=False)  # -> Set, Count
equals = Equality(FirstNumber=pdecon.ZComponent, SecondNumber=graft(dcon.Set))  # -> Equality, Inequality
dispatch = Dispatch(List=geo, DispatchPattern=equals.Equality)  # -> ListA, ListB
dispatch_2 = Dispatch(List=pt_2, DispatchPattern=equals.Equality)  # -> ListA, ListB
pt_3 = Point(simplify(dispatch_2.ListA))
geo_2 = Geometry(dispatch.ListA)
bool = Boolean(equals.Equality)
pt_4 = Point(simplify(pt_3))
bool_2 = Boolean(bool)
panel_4 = Panel("visibility graph construction")
number_slider_2 = Slider(1.7, range=0.01..4)
swatch = ColourSwatch(SwatchColor=RGB(207, 207, 207))
number_slider_3 = Slider(17, range=0..30)
number_slider_4 = Slider(1, range=0..2)
Z = UnitZ(Factor=Slider(0.596, range=0..1))
floor_height_or_ave_fl_fl_height = Panel("135")
swatch_2 = ColourSwatch(SwatchColor=RGB(0, 183, 255))
python = PythonScript()  # -> Out, A
path_3 = FilePath("E:\lorenzo_temporary\210King\lines.json")
path_4 = FilePath("E:\lorenzo_temporary\210King\points_ids.json")
swatch_3 = ColourSwatch(SwatchColor=RGB(138, 138, 138))
number_slider_5 = Slider(1, range=0..3)
number_slider_6 = Slider(17, range=0..30)
number_slider_7 = Slider(13, range=0..30)
swatch_4 = ColourSwatch(SwatchColor=RGB(255, 0, 0))
panel_5 = Panel("get max cost")

# ---- group: max / deltaZ
data = Data("135")

# ----
max_feet_distance = Panel("1200")
panel_6 = Panel("360")
entwine = Entwine(FlattenInputs=True)
number_slider_8 = Slider(246, range=190..250)
dom = ConstructDomain(DomainStart="0", DomainEnd="10")
pipeline_2 = GeometryPipeline(
    GroupByLayer=False,
    GroupByType=False,
    IncludeHidden=True,
    IncludeLocked=True,
    LayerFilter="window",
    NameFilter="*",
    TypeFilter=4)
number_slider_9 = Slider(17, range=0..100)
number_slider_10 = Slider(0, range=0..2)
crv = Curve(pipeline_2)
crv_2 = Curve(crv)
curvepoint_2 = PointOnCurve(crv_2, parameter=0.5)
pt_5 = Point(curvepoint_2)
pt_6 = Point(pt_5)
pdecon_2 = Deconstruct(Point=pt_6)  # -> XComponent, YComponent, ZComponent
sort_2 = SortList(Keys=pdecon_2.ZComponent)  # -> Keys, ValuesA
dcon_2 = DeleteConsecutive(Set=sort_2.Keys, Wrap=False)  # -> Set, Count
equals_2 = Equality(FirstNumber=pdecon_2.ZComponent, SecondNumber=graft(dcon_2.Set))  # -> Equality, Inequality
dispatch_3 = Dispatch(List=crv_2, DispatchPattern=equals_2.Equality)  # -> ListA, ListB
dispatch_4 = Dispatch(List=pt_6, DispatchPattern=equals_2.Equality)  # -> ListA, ListB
pt_7 = Point(simplify(dispatch_4.ListA))
geo_3 = Geometry(dispatch_3.ListA)
bool_3 = Boolean(equals_2.Equality)
pt_8 = Point(simplify(pt_7))
offset = Offset(Curve=geo_3, Distance=Slider(2, range=0..10), Plane=PlaneXY(0, 0, 0), Corners=1)
bool_4 = Boolean(bool_3)
trim = TrimTree(Tree=offset, Depth=1)  # -> simplify(Tree)
geo_4 = Geometry(simplify(trim))
tb = TreeBranch(DataTree=crv, BranchIndex=0)
curvepoint_3 = PointOnCurve(tb, parameter=0.5)
divlength = DivideLength(Curve=crv, Length=Slider(17, range=0..100))  # -> Points, Tangents, Parameters
pt_9 = Point(flatten(divlength.Points))
pt_10 = Point(curvepoint_3)
pt_11 = Point(flatten(divlength.Points))

# ---- group: branch by floor
pdecon_3 = Deconstruct(Point=pt_9)  # -> XComponent, YComponent, ZComponent
sort_3 = SortList(Keys=pdecon_3.ZComponent)  # -> Keys, ValuesA
dcon_3 = DeleteConsecutive(Set=sort_3.Keys, Wrap=False)  # -> Set, Count
equals_3 = Equality(FirstNumber=pdecon_3.ZComponent, SecondNumber=graft(dcon_3.Set))  # -> Equality, Inequality
dispatch_5 = Dispatch(List=pt_9, DispatchPattern=equals_3.Equality)  # -> ListA, ListB
pt_12 = Point(simplify(dispatch_5.ListA))

pdecon_4 = Deconstruct(Point=pt_11)  # -> XComponent, YComponent, ZComponent
sort_4 = SortList(Keys=pdecon_4.ZComponent)  # -> Keys, ValuesA
dcon_4 = DeleteConsecutive(Set=sort_4.Keys, Wrap=False)  # -> Set, Count
equals_4 = Equality(FirstNumber=pdecon_4.ZComponent, SecondNumber=graft(dcon_4.Set))  # -> Equality, Inequality
dispatch_6 = Dispatch(List=pt_11, DispatchPattern=equals_4.Equality)  # -> ListA, ListB
pt_13 = Point(simplify(dispatch_6.ListA))

pdecon_5 = Deconstruct(Point=pt_10)  # -> XComponent, YComponent, ZComponent
sort_5 = SortList(Keys=pdecon_5.ZComponent)  # -> Keys, ValuesA
dcon_5 = DeleteConsecutive(Set=sort_5.Keys, Wrap=False)  # -> Set, Count
equals_5 = Equality(FirstNumber=pdecon_5.ZComponent, SecondNumber=graft(dcon_5.Set))  # -> Equality, Inequality
dispatch_7 = Dispatch(List=tb, DispatchPattern=equals_5.Equality)  # -> ListA, ListB
pt_14 = Point(simplify(dispatch_7.ListA))
crv_3 = Curve(dispatch_7.ListA)

# ----
number_slider_11 = Slider(1, range=0..5)
lng = ListLength(List=pt_14)  # -> flatten(Length)
tb_2 = TreeBranch(DataTree=crv_3, BranchIndex=number_slider_10)
lng_2 = ListLength(List=lng)
Z_2 = UnitZ(Factor="-1")
number_slider_12 = Slider(7.3, range=0.1..8)
number_slider_13 = Slider(1, range=0..5)
previewlw = CustomPreviewLineweights(Geometry=tb_2, Shader=ColourSwatch(SwatchColor=RGB(0, 242, 255)), Thickness=number_slider_12)
number_slider_14 = Slider(7, range=0..30)
swatch_5 = ColourSwatch(SwatchColor=RGB(255, 208, 0))
number_slider_15 = Slider(13, range=0..30)
Z_3 = UnitZ(Factor="-5")

pipeline_3 = GeometryPipeline(
    GroupByLayer=False,
    GroupByType=False,
    IncludeHidden=True,
    IncludeLocked=True,
    LayerFilter="door_pt_*",
    NameFilter="*",
    TypeFilter=1)
path_5 = FilePath(path)
panel_7 = Panel(path_5)
id = Guid(pipeline_3)
reset = Button()
id_2 = Guid(flatten(pipeline_3))
reset_2 = Button()
number_slider_16 = Slider(0, range=0..249)

python_2 = PythonScript(jsonFp=path, jsonCategory="employees", pt_guid=id, layerName="name_text", reset=reset)  # -> out, location, data, remainingPts, matchLn; inputs pt_guid: list
# ---------- python_2: Python ----------
import Rhino
import rhinoscriptsyntax as rs
import scriptcontext as sc

import json

name_match = []
id_match = []
matchedID = []

names = []

matchLn = []

with open( jsonFp, mode='r' ) as infile:
    dataset = json.load(infile)[jsonCategory]
    for person in dataset:
        name_match.append( person['_name_first'][0] + " " + person['_name_last'] )
        names = name_match
        id_match.append( person[ '_id' ] )


rDoc = Rhino.RhinoDoc.ActiveDoc
sc.doc = rDoc

guids = []

text_location = []
text_contents = []

location = []
data = []

doorPts = [ rs.coerce3dpoint( item ) for item in pt_guid ]



if not reset:
    try:
        guids.extend(rs.ObjectsByLayer(layerName))
    except:
        print layer + " doesn't exist"

for item in guids:
    text_contents.append( rs.TextObjectText(item) )
    text_location.append( rs.TextObjectPoint(item) )

sc.doc = ghdoc

for i in range( len(text_location) ):
    if text_contents[i] in name_match:
        name_idx = name_match.index(text_contents[i])
        uid = None
        if name_idx > -1:
            del name_match[ name_idx ]
            uid = id_match.pop( name_idx )
            myName = names.pop( name_idx )
            
            cp_idx = rs.PointArrayClosestPoint( doorPts, text_location[i] )
            if cp_idx :
                del doorPts[ cp_idx ]
                loc = pt_guid.pop(cp_idx)
                location.append( str(loc) )
                data.append( uid )
                matchLn.append( text_location[i]  )
        else:
            print text_contents[i] + " not found"

remainingPts = [str(item) for item in pt_guid]
unMatched = name_match
print unMatched
# ---------- end python_2 ----------

# ---- group: reference empl IDs to plan
python_3 = PythonScript(jsonFp=path, jsonCategory="employees", pt_guid=id, layerName="name_text", reset=reset)  # -> out, location, data, remainingPts, matchLn; inputs pt_guid: list
# ---------- python_3: Python ----------
import Rhino
import rhinoscriptsyntax as rs
import scriptcontext as sc

import json

name_match = []
id_match = []
matchedID = []

matchLn = []

with open( jsonFp, mode='r' ) as infile:
    dataset = json.load(infile)[jsonCategory]
    for person in dataset:
        name_match.append( person['_name_first'][0] + " " + person['_name_last'] )
        id_match.append( person[ '_id' ] )

rDoc = Rhino.RhinoDoc.ActiveDoc
sc.doc = rDoc

guids = []

text_location = []
text_contents = []

location = []
data = []

doorPts = [ rs.coerce3dpoint( item ) for item in pt_guid ]



if not reset:
    try:
        guids.extend(rs.ObjectsByLayer(layerName))
    except:
        print layer + " doesn't exist"

for item in guids:
    text_contents.append( rs.TextObjectText(item) )
    text_location.append( rs.TextObjectPoint(item) )

sc.doc = ghdoc

for i in range( len(text_location) ):
    if text_contents[i] in name_match:
        name_idx = name_match.index(text_contents[i])
        uid = None
        if name_idx > -1:
            del name_match[ name_idx ]
            uid = id_match.pop( name_idx )
            
            
            cp_idx = rs.PointArrayClosestPoint( doorPts, text_location[i] )
            if cp_idx :
                del doorPts[ cp_idx ]
                loc = pt_guid.pop(cp_idx)
                location.append( str(loc) )
                data.append( uid )
                matchLn.append( text_location[i]  )
        else:
            print text_contents[i] + " not found"

remainingPts = [str(item) for item in pt_guid]
unMatched = name_match
# ---------- end python_3 ----------

# ---- group: returns list of point location with matching IDs
python_4 = PythonScript(fp=path_5, geo_id=id_2, category="employees", dictKey="neighbor_id")  # -> out, employeeID, managersID, divisionID, amenityID; inputs geo_id: list
# ---------- python_4: Python ----------
import json
import rhinoscriptsyntax as rs

#list shuffling for MVP
from random import shuffle

employeeID = []
managersID = []
divisionID = []
amenityID = []

with open(fp, mode='r') as infile:
    jsonData = json.load(infile)
    
    dataSet = jsonData[ category ]
    print dataSet
    #create shuffled iterator for processing data list
    iter = [i for i in range( len(dataSet) )]
    #print(iter)
    shuffle(iter)
    
    
    for i in range( len(dataSet) ):
        match = []
        manager = []
        neighbour = []
        division = []
        amenity = []
        
        match.append( str(geo_id[i]) )
        match.append( dataSet[ iter[i] ]['_id'] )
        match.append( dataSet[ iter[i] ] ['job_manager_id'])
        match.append( dataSet[ iter[i] ] ['neighbor_id'])
        manager.append( dataSet[ iter[i] ] ['job_manager_id'])
        division.append( dataSet[ iter[i] ] ['neighbor_div'])
        amenity.append( dataSet[ iter[i] ] ['amenity_pref'])
        print match
        
        employeeID.append( match )
        managersID.append( manager )
        divisionID.append( division )
        amenityID.append( amenity )
# ---------- end python_4 ----------

# ---- group: translate ironpy list into data tree
python_5 = PythonScript(listInput=python_4.amenityID)  # -> out, dataTreeOutput
# ---------- python_5: Python ----------
for list in listInput:
    dataTreeOutput = list

#dataTreeOutput = listInput
# ---------- end python_5 ----------

python_6 = PythonScript(listInput=python_4.divisionID)  # -> out, dataTreeOutput; same code as python_5

python_7 = PythonScript(listInput=python_4.employeeID)  # -> out, dataTreeOutput
# ---------- python_7: Python ----------
dataTreeOutput = listInput
# ---------- end python_7 ----------

# ---- group: division manager ID
data_2 = Data(python_6.dataTreeOutput)

# ---- group: amenity
data_3 = Data(python_5.dataTreeOutput)

# ---- group: ptID, empl ID, man ID, neighb ID
data_4 = Data(python_7.dataTreeOutput)

# ---- group: division manager ID
data_5 = Data(data_2)

data_6 = Data(data_2)

# ----
pt_15 = Point(python_3.location)
pt_16 = Point(pt_15)
txt = Text(python_3.data)
pdecon_6 = Deconstruct(Point=pt_16)  # -> XComponent, YComponent, ZComponent
sort_6 = SortList(Keys=pdecon_6.ZComponent)  # -> Keys, ValuesA
dcon_6 = DeleteConsecutive(Set=sort_6.Keys, Wrap=False)  # -> Set, Count
equals_6 = Equality(FirstNumber=pdecon_6.ZComponent, SecondNumber=graft(dcon_6.Set))  # -> Equality, Inequality
dispatch_8 = Dispatch(List=pt_16, DispatchPattern=equals_6.Equality)  # -> ListA, ListB
dispatch_9 = Dispatch(List=txt, DispatchPattern=equals_6.Equality)  # -> ListA, ListB
pt_17 = Point(simplify(dispatch_8.ListA))
data_7 = Data(dispatch_9.ListA)
tb_3 = TreeBranch(DataTree=pt_17, BranchIndex=0)
tb_4 = TreeBranch(DataTree=data_7, BranchIndex=0)
tag = TextTag3D(Location=tb_3, Text=tb_4, Size="9", Justification=5)
python_8 = PythonScript(file=path_4, nodes=tb_3, IDs=tb_4)  # -> out, points; inputs nodes: list, IDs: list
# ---------- python_8: Python ----------
import rhinoscriptsyntax as rs
import json

#print nodes
nCoord = []
for i in range(len(nodes)):
    pX = (rs.coerce3dpoint(nodes[i])).X
    pY = (rs.coerce3dpoint(nodes[i])).Y
    pZ = (rs.coerce3dpoint(nodes[i])).Z
    
    nCoord.append((pX,pY,pZ))
    
#print nCoord

points = zip(IDs, nCoord)

dict_ID = {}

for IDs, nCoord in points:
    dict_ID[IDs] = nCoord
format = "dictionary > {IDnn: 'x,y,z'}"
#print format
#print dict_ID

"""
with open("textTest", "w") as outfile:
    file.write(json.dumps(dict_ID))
"""
#dict_ID = json.dumps(dict_ID)

jsonSrc = file
with open(jsonSrc, mode='w') as outfile:
    json.dump( dict_ID, outfile, indent=4, separators=(',', ': ') )


points = dict_ID
print dict_ID
# ---------- end python_8 ----------
panel_8 = Panel(python_8.points)

id_3 = Guid(python_3.remainingPts)
pt_18 = Point(python_3.location)
txt_2 = Text(python_3.data)
item = ListItem(List=pt_18, Index=number_slider_16, Wrap=True)
item_2 = ListItem(List=txt_2, Index=number_slider_16, Wrap=True)
panel_9 = Panel(item)
tag_2 = TextTag3D(Location=item, Text=item_2, Size="9", Justification=5)
tag_3 = TextTag3D(Location=pt_18, Text=txt_2, Size="9", Justification=5)
pt_19 = Point(python_3.matchLn)
ln = Line(StartPoint=pt_18, EndPoint=pt_19)
panel_10 = Panel(data_2)
panel_11 = Panel(data_3)
tb_5 = TreeBranch(DataTree=data_3, BranchIndex=Slider(55, range=0..100))
amp = Amplitude(Vector=ln, Amplitude="6")
rev = Reverse(Vector=amp)
item_3 = ListItem(List=data_4, Index=3, Wrap=True)
panel_12 = Panel(data_4)
move = Move(Geometry=pt_18, Motion=rev)  # -> Geometry, Transform
item_4 = ListItem(List=data_4, Index=1, Wrap=True)  # -> flatten(Item)
item_5 = ListItem(List=data_4, Index=2, Wrap=True)  # -> flatten(Item)

# ---- group: reference amenities IDs to plan
python_9 = PythonScript(jsonFp=path_2, jsonCategory="amenities", pt_guid=id_3, layerName="amenity_text", reset=reset_2)  # -> out, location, data, remainingPts, matchLn; inputs pt_guid: list
# ---------- python_9: Python ----------
import Rhino
import rhinoscriptsyntax as rs
import scriptcontext as sc

import json

name_match = []
id_match = []
matchedID = []

matchLn = []

with open( jsonFp, mode='r' ) as infile:
    dataset = json.load(infile)[jsonCategory]
    for person in dataset:
        name_match.append( person['name'] )
        id_match.append( person[ '_id' ] )

rDoc = Rhino.RhinoDoc.ActiveDoc
sc.doc = rDoc

guids = []

text_location = []
text_contents = []

location = []
data = []

doorPts = [ rs.coerce3dpoint( item ) for item in pt_guid ]



if not reset:
    try:
        guids.extend(rs.ObjectsByLayer(layerName))
    except:
        print layer + " doesn't exist"

for item in guids:
    text_contents.append( rs.TextObjectText(item) )
    text_location.append( rs.TextObjectPoint(item) )

sc.doc = ghdoc

for i in range( len(text_location) ):
    if text_contents[i] in name_match:
        name_idx = name_match.index(text_contents[i])
        if name_idx > -1:
            
            cp_idx = rs.PointArrayClosestPoint( doorPts, text_location[i] )
            if cp_idx :
                del doorPts[ cp_idx ]
                loc = pt_guid.pop(cp_idx)
                location.append( str(loc) )
                data.append( name_match[name_idx] )
                matchLn.append( text_location[i]  )
        else:
            print text_contents[i] + " not found"

remainingPts = [str(item) for item in pt_guid]
unMatched = name_match
# ---------- end python_9 ----------

# ---- group: translate ironpy list into data tree
python_10 = PythonScript(listInput=item_3)  # -> out, dataTreeOutput; same code as python_7

# ---- group: empl ID
data_8 = Data(item_4)

# ---- group: manager ID
data_9 = Data(item_5)

# ---- group: neighbours ID
data_10 = Data(python_10.dataTreeOutput)

# ----
merge = Merge(Data1=simplify(data_2), Data2=simplify(data_10))
pt_20 = Point(pt_18)

# ---- group: Branch Pts Per Floor
cluster = Cluster(pt=pt_20)  # -> bool_2, pt_4

# ----
pt_21 = Point(simplify(cluster.pt_4))
bool_5 = Boolean(cluster.bool_2)
dispatch_10 = Dispatch(List=txt_2, DispatchPattern=bool_5)  # -> ListA, ListB
txt_3 = Text(dispatch_10.ListA)
tb_6 = TreeBranch(DataTree=pt_21, BranchIndex=number_slider_10)
tb_7 = TreeBranch(DataTree=txt_3, BranchIndex=number_slider_10)
tag_4 = TextTag3D(Location=tb_6, Text=tb_7, Size=Slider(15, range=0..20), Colour=ColourSwatch(SwatchColor=RGB(0, 0, 0)), Justification=5)

# ---- group: empl ID in existing plan
txt_4 = Text(txt_2)

# ---- group: neighbours ID
data_11 = Data(python_10.dataTreeOutput)

# ---- group: neighb ID
data_12 = Data(data_10)

data_13 = Data(data_10)

# ----
panel_13 = Panel(data_12)

# ---- group: ID to search for
data_14 = Data(txt_4)

# ---- group: matched Empl ID
data_15 = Data(txt_4)

data_16 = Data(txt_4)

data_17 = Data(txt_4)

# ---- group: ID to search for
# match json data with plan node locations and get desired paths
data_18 = Data(txt_4)

data_19 = Data(txt_4)

data_20 = Data(txt_4)

# ---- group: matched Empl ID
data_21 = Data(txt_4)

# ---- group: Matched Empl ID w/ ManID
data_22 = Data(data_8)

# ---- group: manager ID
data_23 = Data(item_5)

# ---- group: matched Empl ID
data_24 = Data(txt_4)

# ---- group: Matched Empl ID w/ ManID
data_25 = Data(data_8)

# ---- group: matched Empl ID
data_26 = Data(txt_4)

data_27 = Data(txt_4)

# ---- group: Matched Empl ID w/ ManID
data_28 = Data(data_8)

# ---- group: matched Empl ID
data_29 = Data(txt_4)

# ---- group: Matched Empl ID w/ ManID
data_30 = Data(data_8)

# ---- group: matched Empl ID
data_31 = Data(txt_4)

data_32 = Data(txt_4)

data_33 = Data(txt_4)

# ---- group: empl ID in existing plan
txt_5 = Text(txt_4)

txt_6 = Text(txt_4)

# ----
pt_22 = Point(python_9.matchLn)
pt_23 = Point(python_9.location)
txt_7 = Text(python_9.data)
tag_5 = TextTag3D(Location=pt_23, Text=txt_7, Size="9", Justification=5)
ln_2 = Line(StartPoint=pt_23, EndPoint=pt_22)
panel_14 = Panel(txt_7)
amp_2 = Amplitude(Vector=ln_2, Amplitude="6")
python_11 = PythonScript(listAmenities=txt_7, pref=tb_5)  # -> out, a; inputs listAmenities: list, pref: list
# ---------- python_11: Python ----------
print pref
#print listAmenities
output = []
for myPref in pref:
    i = 0
    if myPref:
        for myAmenity in listAmenities:
            result = myAmenity.find(myPref)
            #print result
            if result != -1:
                output.append(i)
            i += 1

print output
# ---------- end python_11 ----------
rev_2 = Reverse(Vector=amp_2)
move_2 = Move(Geometry=pt_23, Motion=rev_2)  # -> Geometry, Transform
pt_24 = Point(python_9.remainingPts)
panel_15 = Panel(python_11.out)
panel_16 = Panel(data_10)
panel_17 = Panel(data_8)
panel_18 = Panel(data_9)

# ---- group: look for matching amenities in 210 King plan
python_12 = PythonScript(listAmenities=txt_7, pref=data_3)  # -> out, output; inputs listAmenities: list, pref: list
# ---------- python_12: Python ----------
#print listAmenities
output = []
for myPref in pref:
    i = 0
    if myPref:
        for myAmenity in listAmenities:
            result = myAmenity.find(myPref)
            #print result
            if result != -1:
                output.append(i)
            i += 1

print output
# ---------- end python_12 ----------

# ---- group: amenity ID
data_34 = Data(python_12.output)

# ----
panel_19 = Panel(python_12.output)
item_6 = ListItem(List=pt_23, Index=data_34, Wrap=True)
panel_20 = Panel(item_6)

item_7 = ListItem(List=txt_7, Index=data_34, Wrap=True)

# ---- group: amenity Pts
pt_25 = Point(item_6)

# ----
panel_21 = Panel(item_7)

# ---- group: amenity Pts
pt_26 = Point(pt_25)

# ----
data_35 = Data(item_7)

# ---- group: amenity ID
data_36 = Data(python_12.output)

data_37 = Data(python_12.output)

# ----
panel_22 = Panel(data_36)
panel_23 = Panel(data_35)

# ---- group: amenity pt
pt_27 = Point(pt_26)

# ----
number_slider_17 = Slider(10, range=0..10)
crv_4 = Curve(simplify(graft([<curve referenced from the Rhino model> x3])))
Z_4 = UnitZ(Factor=expr("-x/2", number_slider_17))
Z_5 = UnitZ(Factor=number_slider_17)
move_3 = Move(Geometry=crv_4, Motion=Z_4)  # -> Geometry, Transform
extr = Extrude(Base=move_3.Geometry, Direction=Z_5)
cap = CapHoles(Brep=extr)
python_13 = PythonScript(pts=move.Geometry, breps=cap)  # -> out, output; inputs pts: list of Point3d, breps: list of Brep
# ---------- python_13: Python ----------
import rhinoscriptsyntax as rs
import ghpythonlib.components as ghcomp

def inMyBrep(pt):
    for volume in breps:
        if ghcomp.PointInBrep(volume, pt, True):
            return pt
        
    return


output = [inMyBrep(item) for item in pts]
# ---------- end python_13 ----------
python_14 = PythonScript(pts=pt_24, breps=cap)  # -> out, output; inputs pts: list of Point3d, breps: list of Brep; same code as python_13
python_15 = PythonScript(pts=move_2.Geometry, breps=cap)  # -> out, output; inputs pts: list of Point3d, breps: list of Brep; same code as python_13
clean = CleanTree(RemoveNulls=True, RemoveInvalid=True, RemoveEmpty=False, Tree=python_13.output)
clean_2 = CleanTree(RemoveNulls=True, RemoveInvalid=True, RemoveEmpty=False, Tree=python_14.output)
clean_3 = CleanTree(RemoveNulls=True, RemoveInvalid=True, RemoveEmpty=False, Tree=python_15.output)
pt_28 = Point(simplify(clean))
pt_29 = Point(simplify(clean_2))
pt_30 = Point(simplify(clean_3))

tb_8 = TreeBranch(DataTree=pt_28, BranchIndex=Slider(0, range=0..2))
tb_9 = TreeBranch(DataTree=pt_29, BranchIndex=Slider(0, range=0..2))
tb_10 = TreeBranch(DataTree=pt_30, BranchIndex=Slider(0, range=0..2))
pt_31 = Point(tb_10)
pt_32 = Point([tb_9, tb_8])
dots = DotDisplay(Point=pt_32, Colour=ColourSwatch(SwatchColor=RGB(255, 120, 120)), Size=Slider(10, range=0..10))
dots_2 = DotDisplay(Point=pt_31, Colour=ColourSwatch(SwatchColor=RGB(120, 255, 196)), Size=Slider(10, range=0..10))

pipeline_4 = GeometryPipeline(
    GroupByLayer=False,
    GroupByType=False,
    IncludeHidden=True,
    IncludeLocked=True,
    LayerFilter="wall_int*",
    NameFilter="*",
    TypeFilter=4)
pipeline_5 = GeometryPipeline(
    GroupByLayer=False,
    GroupByType=False,
    IncludeHidden=True,
    IncludeLocked=True,
    LayerFilter="bound*",
    NameFilter="*",
    TypeFilter=4)
pipeline_6 = GeometryPipeline(
    GroupByLayer=False,
    GroupByType=False,
    IncludeHidden=True,
    IncludeLocked=True,
    LayerFilter="am*",
    NameFilter="*",
    TypeFilter=4)
pipeline_7 = GeometryPipeline(
    GroupByLayer=False,
    GroupByType=False,
    IncludeHidden=True,
    IncludeLocked=True,
    LayerFilter="ws_*",
    NameFilter="*",
    TypeFilter=4)
pipeline_8 = GeometryPipeline(
    GroupByLayer=False,
    GroupByType=False,
    IncludeHidden=True,
    IncludeLocked=True,
    LayerFilter="rm_*",
    NameFilter="*",
    TypeFilter=4)
pipeline_9 = GeometryPipeline(
    GroupByLayer=False,
    GroupByType=False,
    IncludeHidden=True,
    IncludeLocked=True,
    LayerFilter="col*",
    NameFilter="*",
    TypeFilter=4)
pipeline_10 = GeometryPipeline(
    GroupByLayer=False,
    GroupByType=False,
    IncludeHidden=True,
    IncludeLocked=True,
    LayerFilter="v_edges",
    NameFilter="*",
    TypeFilter=4)
pipeline_11 = GeometryPipeline(
    GroupByLayer=False,
    GroupByType=False,
    IncludeHidden=True,
    IncludeLocked=True,
    LayerFilter="v_nodes",
    NameFilter="*",
    TypeFilter=1)
num = Number(number_slider)
num_2 = Number(panel_3)
crv_5 = Curve(pipeline_10)
pt_33 = Point(pipeline_11)
pipeline_12 = GeometryPipeline(
    GroupByLayer=False,
    GroupByType=False,
    IncludeHidden=True,
    IncludeLocked=True,
    LayerFilter="door_pt*",
    NameFilter="*",
    TypeFilter=1)

# ---- group: column geo
geo_5 = Geometry(pipeline_4)

# ---- group: amenity geo
geo_6 = Geometry(pipeline_6)

# ---- group: workspace geo
geo_7 = Geometry(pipeline_7)

# ---- group: boundary geo
geo_8 = Geometry(pipeline_5)

# ---- group: room geo
geo_9 = Geometry(pipeline_8)

# ---- group: column geo
geo_10 = Geometry(pipeline_9)

# ----
id_4 = Guid(geo_5)
python_16 = PythonScript(geo=id_4)  # -> out, output; inputs geo: list
# ---------- python_16: Python ----------
import Rhino.RhinoDoc as rd
import rhinoscriptsyntax as rs

import Rhino.Geometry as rg
from clr import AddReference as addr
addr("Grasshopper")

from System import Object
from Grasshopper import DataTree
from Grasshopper.Kernel.Data import GH_Path

def raggedListToDataTree(raggedList):
    rl = raggedList
    result = DataTree[object]()
    for i in range(len(rl)):
        temp = []
        for j in range(len(rl[i])):
            temp.append(rl[i][j])
        #print i, " - ",temp
        path = GH_Path(i)
        result.AddRange(temp, path)
    return result

doc = rd.ActiveDoc
orderDict = {'4' : 0, '5' : 1, '6' : 2}

output=[[],[],[]]

#GH Methods
def extractLayerName( guid ):
    layer = doc.Objects.Find( guid ).Attributes.LayerIndex
    layerName = doc.Layers[ layer ].Name
    return layerName.split( "_" )[ -1 ]

for item in geo:
    layer_idx = extractLayerName(item)
    idx = orderDict[layer_idx]
    output[idx].append( str(item) )
    #print item

output = raggedListToDataTree(output)
# ---------- end python_16 ----------
geo_11 = Geometry(simplify(python_16.output))

id_5 = Guid(geo_8)
python_17 = PythonScript(geo=id_5)  # -> out, output; inputs geo: list; same code as python_16
area = Area(Geometry=python_17.output)  # -> Area, Centroid
sort_7 = SortList(Keys=area.Area, ValuesA=python_17.output)  # -> reverse(Keys), reverse(ValuesA)
split = SplitList(List=sort_7.ValuesA, Index="1")  # -> ListA, ListB
geo_12 = Geometry(simplify(split.ListB))
geo_13 = Geometry(simplify(split.ListA))

id_6 = Guid(geo_6)
python_18 = PythonScript(geo=id_6)  # -> out, output; inputs geo: list
# ---------- python_18: Python ----------
import Rhino.RhinoDoc as rd
import rhinoscriptsyntax as rs

import Rhino.Geometry as rg
from clr import AddReference as addr
addr("Grasshopper")

from System import Object
from Grasshopper import DataTree
from Grasshopper.Kernel.Data import GH_Path

def raggedListToDataTree(raggedList):
    rl = raggedList
    result = DataTree[object]()
    for i in range(len(rl)):
        temp = []
        for j in range(len(rl[i])):
            temp.append(rl[i][j])
        #print i, " - ",temp
        path = GH_Path(i)
        result.AddRange(temp, path)
    return result

doc = rd.ActiveDoc
orderDict = {'4' : 0, '5' : 1, '6' : 2}

output=[[],[],[]]

#GH Methods
def extractLayerName( guid ):
    layer = doc.Objects.Find( guid ).Attributes.LayerIndex
    layerName = doc.Layers[ layer ].Name
    return layerName.split( "_" )[ -1 ]

for item in geo:
    layer_idx = extractLayerName(item)
    idx = orderDict[layer_idx]
    output[idx].append( str(item) )
    print item

output = raggedListToDataTree(output)
# ---------- end python_18 ----------
geo_14 = Geometry(simplify(python_18.output))

id_7 = Guid(geo_9)
python_19 = PythonScript(geo=id_7)  # -> out, output; inputs geo: list; same code as python_16
geo_15 = Geometry(simplify(python_19.output))

id_8 = Guid(geo_10)
python_20 = PythonScript(geo=id_8)  # -> out, output; inputs geo: list; same code as python_16
geo_16 = Geometry(simplify(python_20.output))

pdecon_7 = Deconstruct(Point=pt_33)  # -> XComponent, YComponent, ZComponent
sort_8 = SortList(Keys=pdecon_7.ZComponent)  # -> Keys, ValuesA
dcon_7 = DeleteConsecutive(Set=sort_8.Keys, Wrap=False)  # -> Set, Count
equals_7 = Equality(FirstNumber=pdecon_7.ZComponent, SecondNumber=graft(dcon_7.Set))  # -> Equality, Inequality
dispatch_11 = Dispatch(List=pt_33, DispatchPattern=equals_7.Equality)  # -> ListA, ListB
pt_34 = Point(simplify(dispatch_11.ListA))

# ---- group: boundary geo
geo_17 = Geometry(pipeline_12)

# ---- group: Calculate search depth
num_3 = Number(num)
num_4 = Number(num_2)
multiplication = Multiplication(A=num_4, B=num_3)
multiplication_2 = Multiplication(A=multiplication, B="1.5")

# ---- group: v_edges
crv_6 = Curve(crv_5)  # disabled

# ---- group: remove invalid edges / v_edges
crv_7 = Curve(crv_5)

# ---- group: grid res
data_38 = Data(num_2)

data_39 = Data(num_2)

data_40 = Data(num_2)

data_41 = Data(num_2)

# ----
multiplication_3 = Multiplication(A=data_38, B=Slider(0.99, range=0.3..2))
# normalize cost per shortest path and get final score
multiplication_4 = Multiplication(A=data_39, B=Slider(0.99, range=0.3..2))
multiplication_5 = Multiplication(A=data_40, B=Slider(0, range=0..2))
multiplication_6 = Multiplication(A=data_41, B=Slider(0, range=0..2))

# ---- group: normalize cost / min cost
data_42 = Data(multiplication_5)

data_43 = Data(multiplication_3)

data_44 = Data(multiplication_4)

data_45 = Data(multiplication_6)

data_46 = Data(multiplication_6)

data_47 = Data(multiplication_6)

data_48 = Data(multiplication_3)

data_49 = Data(multiplication_4)

# ----
id_9 = Guid(geo_7)

python_21 = PythonScript(geo=id_9)  # -> out, output; inputs geo: list; same code as python_18
panel_24 = Panel(geo_13)
merge_2 = Merge(Data1=simplify(geo_2), Data2=geo_11, Data4=geo_16, Data5=geo_4)
tb_11 = TreeBranch(DataTree=pt_34, BranchIndex=Slider(2, range=0..2))

geo_18 = Geometry(simplify(python_21.output))

crv_8 = Curve(geo_18)
area_2 = Area(Geometry=crv_8)  # -> Area, Centroid
pt_35 = Point(flatten(area_2.Centroid))
pt_36 = Point(area_2.Centroid)
tb_12 = TreeBranch(DataTree=pt_36, BranchIndex=number_slider_10)
dots_3 = DotDisplay(Point=tb_12, Colour=ColourSwatch(SwatchColor=RGB(255, 0, 0)), Size=Slider(13, range=0..30))
dots_4 = DotDisplay(Point=tb_12, Colour=ColourSwatch(SwatchColor=RGB(255, 0, 0)), Size=Slider(13, range=0..30))

# ---- group: branch by floor
pdecon_8 = Deconstruct(Point=pt_35)  # -> XComponent, YComponent, ZComponent
sort_9 = SortList(Keys=pdecon_8.ZComponent)  # -> Keys, ValuesA
dcon_8 = DeleteConsecutive(Set=sort_9.Keys, Wrap=False)  # -> Set, Count
equals_8 = Equality(FirstNumber=pdecon_8.ZComponent, SecondNumber=graft(dcon_8.Set))  # -> Equality, Inequality
dispatch_12 = Dispatch(List=pt_35, DispatchPattern=equals_8.Equality)  # -> ListA, ListB
pt_37 = Point(simplify(dispatch_12.ListA))

# ----
geo_19 = Geometry(simplify(merge_2))
null = NullItem(Item=geo_19)  # -> NullFlags, InvalidFlags, Description
geo_20 = Geometry(simplify(merge_2))
null_2 = NullItem(Item=geo_20)  # -> NullFlags, InvalidFlags, Description
dispatch_13 = Dispatch(List=geo_20, DispatchPattern=null_2.NullFlags)  # -> ListA, ListB
dispatch_14 = Dispatch(List=geo_19, DispatchPattern=null.NullFlags)  # -> ListA, ListB
crv_9 = Curve(simplify(dispatch_13.ListB))
crv_10 = Curve(simplify(dispatch_14.ListB))
lng_3 = ListLength(List=pt_37)
bs = BranchCount(String=lng_3)
larger = LargerThan(FirstNumber=flatten(lng_3), SecondNumber="1")  # -> LargerThan, OrEqualTo
series = Series(Start=0, Step=1, Count=bs)
dispatch_15 = Dispatch(List=series, DispatchPattern=larger.LargerThan)  # -> ListA, ListB
move_4 = Move(Geometry=tb_12, Motion=Z_2)  # -> Geometry, Transform
tb_13 = TreeBranch(DataTree=pt_37, BranchIndex=dispatch_15.ListA)
dots_5 = DotDisplay(Point=move_4.Geometry, Colour=ColourSwatch(SwatchColor=RGB(0, 144, 255)), Size=Slider(13, range=0..30))
pt_38 = Point(simplify(tb_13))
python_22 = PythonScript(circPts=pt_38, windPts=pt_12)  # -> out, lines; inputs circPts: list of Point3d, windPts: list of Point3d
# ---------- python_22: Python ----------
import rhinoscriptsyntax as rs

lines = []

for i in range(len(circPts)):
    
    myPt = circPts[i]
    
    for j in range(len(windPts)):
        
        myWindPt = windPts[j]
        if rs.Distance(myPt, myWindPt) > 0 and rs.Distance(myPt, myWindPt) <= 480:
            lines.append(rs.AddLine(myPt, myWindPt))
# ---------- end python_22 ----------
line = Line(simplify(python_22.lines))
null_3 = NullItem(Item=line)  # -> NullFlags, InvalidFlags, Description
dispatch_16 = Dispatch(List=line, DispatchPattern=null_3.NullFlags)  # -> ListA, ListB
line_2 = Line(simplify(dispatch_16.ListB))
python_23 = PythonScript(lines=line_2, collision=crv_9, parallel=Toggle(True))  # -> out, outLn; inputs lines: list of Curve, collision: list of Curve
# ---------- python_23: Python ----------
import rhinoscriptsyntax as rs
import ghpythonlib.parallel as pl


outLn = []

def checkIntersect(ln):
    hits = 0
    
    for item in collision:
        #print hits
        if hits > 0:
            break
        result = rs.CurveCurveIntersection(ln, item)
        
        if result:
            #print result
            #print len(result)
            #print "HIT!"
            hits += len(result)
            #print hits
    if hits > 0: return
    return ln



if parallel:
    output = pl.run(checkIntersect, lines, True)
    for item in output:
        if item:
            outLn.append(item)
else:
    for ln in lines:
        result = checkIntersect(ln)
        if result:
            outLn.append(ln)
# ---------- end python_23 ----------
crv_11 = Curve(python_23.outLn)
end = EndPoints(Curve=crv_11)  # -> Start, End
pt_39 = Point(end.Start)
rdpoints = RemoveDuplicatePointsKaramba(Point=pt_39, LDist=0.005)  # -> OutPoint, Info, Indexes
tb_14 = TreeBranch(DataTree=crv_11, BranchIndex=number_slider_10)
trim_2 = TrimTree(Tree=rdpoints.OutPoint, Depth=0)
tb_15 = TreeBranch(DataTree=trim_2, BranchIndex=number_slider_10)
previewlw_2 = CustomPreviewLineweights(Geometry=tb_14, Shader=ColourSwatch(SwatchColor=RGB(186, 186, 186)), Thickness=Slider(0.7, range=0.1..3))
lng_4 = ListLength(List=crv_11)

# ---- group: True
data_50 = Data(tb_15)

# ----
lng_5 = ListLength(List=rdpoints.OutPoint)
lng_6 = ListLength(List=pt_38)

# ---- group: # of nodes with rays
data_51 = Data(lng_5)

# ---- group: Remaining View Rays
data_52 = Data(lng_4)

# ---- group: tot # of sample nodes
data_53 = Data(lng_6)

# ----
division = Division(A=data_51, B=data_53)
panel_25 = Panel(data_52)
dots_6 = DotDisplay(Point=tb_15, Colour=ColourSwatch(SwatchColor=RGB(255, 0, 0)), Size=Slider(13, range=0..30))
multiplication_7 = Multiplication(A=division, B=10)

# ---- group: %View to Outside per Floor
data_54 = Data(multiplication_7)

# ----
avr = Average(Input=flatten(data_54))

# ---- group: Global View to Outside
# n of Sample Pt w/ at least one ray / Tot n of Sample Rays
data_55 = Data(avr)

# ----
panel_26 = Panel(data_55)
panel_27 = Panel(data_54)
panel_28 = Panel(avr)

bs_2 = BranchCount(String=data_12)
series_2 = Series(Start=0, Step=1, Count=bs_2)
geo_21 = Geometry(pt_18)
int = Integer(data_18)
int_2 = Integer(data_18)
txt_8 = Text(int)
keysearch = KeyValueSearch(Keys=data_24, Values=geo_21, Search=txt_8)
geo_22 = Geometry(pt_18)
Z_6 = UnitZ(Factor=10)
Z_7 = UnitZ(Factor=10)

# ---- group: neighb ID
data_56 = Data(series_2)

# ---- group: empl ID pt
pt_40 = Point(keysearch)

# ----
pt_41 = Point(pt_40)
lng_7 = ListLength(List=pt_41)
series_3 = Series(Start=0, Step=1, Count=lng_7)

pdecon_9 = Deconstruct(Point=pt_41)  # -> XComponent, YComponent, ZComponent
sort_10 = SortList(Keys=pdecon_9.ZComponent)  # -> Keys, ValuesA
dcon_9 = DeleteConsecutive(Set=sort_10.Keys, Wrap=False)  # -> Set, Count
equals_9 = Equality(FirstNumber=pdecon_9.ZComponent, SecondNumber=graft(dcon_9.Set))  # -> Equality, Inequality
dispatch_17 = Dispatch(List=pt_41, DispatchPattern=equals_9.Equality)  # -> ListA, ListB
pt_42 = Point(simplify(dispatch_17.ListA))

data_57 = Data(pt_42)
lng_8 = ListLength(List=data_57)  # -> flatten(Length)
dispatch_18 = Dispatch(List=series_3, DispatchPattern=equals_9.Equality)  # -> ListA, ListB
data_58 = Data(dispatch_18.ListA)
viewer = ParamViewer(pt_42)
data_59 = Data(pt_42)
data_60 = Data(pt_42)
lng_9 = ListLength(List=data_59)  # -> flatten(Length)
lng_10 = ListLength(List=data_60)  # -> flatten(Length)

geo_23 = Geometry(pt_18)
int_3 = Integer(data_11)
txt_9 = Text(int_3)
number_slider_18 = Slider(1, range=0..1)
keysearch_2 = KeyValueSearch(Keys=data_15, Values=geo_23, Search=txt_9)
tb_16 = TreeBranch(DataTree=txt_9, BranchIndex=number_slider_18)
panel_29 = Panel(tb_16)

# ---- group: empl ID pt
pt_43 = Point(keysearch_2)

# ----
geo_24 = Geometry(pt_18)
int_4 = Integer(data_5)
txt_10 = Text(int_4)
number_slider_19 = Slider(1, range=0..1)
keysearch_3 = KeyValueSearch(Keys=data_16, Values=geo_24, Search=txt_10)
tb_17 = TreeBranch(DataTree=txt_10, BranchIndex=number_slider_19)
panel_30 = Panel(tb_17)

# ---- group: empl ID pt
pt_44 = Point(keysearch_3)

# ----
geo_25 = Geometry(pt_18)
int_5 = Integer(data_5)
txt_11 = Text(int_5)
number_slider_20 = Slider(1, range=0..1)
keysearch_4 = KeyValueSearch(Keys=data_17, Values=geo_25, Search=txt_11)
tb_18 = TreeBranch(DataTree=pt_27, BranchIndex=number_slider_20)
tb_19 = TreeBranch(DataTree=txt_11, BranchIndex=number_slider_20)
panel_31 = Panel(tb_19)

bs_3 = BranchCount(String=data_36)
series_4 = Series(Start=0, Step=1, Count=bs_3)
geo_26 = Geometry(pt_18)
int_6 = Integer(data_19)
int_7 = Integer(data_19)
txt_12 = Text(int_6)
keysearch_5 = KeyValueSearch(Keys=data_27, Values=geo_26, Search=txt_12)
geo_27 = Geometry(pt_18)
Z_8 = UnitZ(Factor=10)
Z_9 = UnitZ(Factor=10)

# ---- group: neighb ID
data_61 = Data(series_4)

# ----
keysearch_6 = KeyValueSearch(Keys=data_32, Values=geo_27)

# ---- group: empl ID pt
pt_45 = Point(keysearch_5)

# ----
bs_4 = BranchCount(String=data_6)
series_5 = Series(Start=0, Step=1, Count=bs_4)
geo_28 = Geometry(pt_18)
int_8 = Integer(data_20)
int_9 = Integer(data_20)
txt_13 = Text(int_8)
keysearch_7 = KeyValueSearch(Keys=data_29, Values=geo_28, Search=txt_13)
geo_29 = Geometry(pt_18)
Z_10 = UnitZ(Factor=10)
Z_11 = UnitZ(Factor=10)

# ---- group: neighb ID
data_62 = Data(series_5)

# ---- group: empl ID pt
pt_46 = Point(keysearch_7)

# ----
int_10 = Integer(data_14)
geo_30 = Geometry(pt_18)
int_11 = Integer(data_14)
txt_14 = Text(int_10)
keysearch_8 = KeyValueSearch(Keys=data_21, Values=geo_30, Search=txt_14)
keysearch_9 = KeyValueSearch(Keys=data_22, Values=data_23, Search=int_11)
geo_31 = Geometry(pt_18)
Z_12 = UnitZ(Factor=10)
Z_13 = UnitZ(Factor=10)

# ---- group: matched Man ID
data_63 = Data(keysearch_9)

# ---- group: empl ID pt
pt_47 = Point(keysearch_8)

# ----
tb_20 = TreeBranch(DataTree=pt_43, BranchIndex=number_slider_18)
ln_3 = Line(StartPoint=graft(pt_47), EndPoint=pt_43)

# ---- group: empl - neighbours
line_3 = Line(flatten(ln_3))

# ----
tb_21 = TreeBranch(DataTree=pt_44, BranchIndex=number_slider_19)
ln_4 = Line(StartPoint=graft(pt_47), EndPoint=pt_44)

# ---- group: empl - division manager ID
line_4 = Line(flatten(ln_4))

# ----
txt_15 = Text(data_63)
keysearch_10 = KeyValueSearch(Keys=data_26, Values=geo_31, Search=txt_15)
panel_32 = Panel(data_63)
move_5 = Move(Geometry=pt_47, Motion=Z_12)  # -> Geometry, Transform
tag_6 = TextTag(Location=move_5.Geometry, Text=data_14, Colour=ColourSwatch(SwatchColor=RGB(0, 0, 0)))

# ---- group: manager ID pt
pt_48 = Point(keysearch_10)

# ----
keysearch_11 = KeyValueSearch(Keys=data_25, Values=data_56, Search=int_2)
move_6 = Move(Geometry=pt_40, Motion=Z_7)  # -> Geometry, Transform
tag_7 = TextTag(Location=move_6.Geometry, Text=data_18, Colour=ColourSwatch(SwatchColor=RGB(0, 0, 0)))

# ---- group: matched Man ID
data_64 = Data(keysearch_11)

# ----
tb_22 = TreeBranch(DataTree=data_12, BranchIndex=data_64)  # -> simplify(Branch)
panel_33 = Panel(tb_22)
txt_16 = Text(tb_22)
keysearch_12 = KeyValueSearch(Keys=data_31, Values=geo_22, Search=txt_16)

# ---- group: neighbour ID pt
pt_49 = Point(keysearch_12)

# ----
move_7 = Move(Geometry=pt_49, Motion=Z_6)  # -> Geometry, Transform
tag_8 = TextTag(Location=move_7.Geometry, Text=data_64, Colour=ColourSwatch(SwatchColor=RGB(255, 0, 251)))
ln_5 = Line(StartPoint=graft(pt_40), EndPoint=pt_49)

# ---- group: empl - neighbours
line_5 = Line(ln_5)

# ----
tb_23 = TreeBranch(DataTree=line_5, BranchIndex=[Slider(154, range=0..249), Slider(86, range=0..249)])

panel_34 = Panel(tb_23)

viewer_2 = ParamViewer(line_5)
data_65 = Data(line_5)
lng_11 = ListLength(List=data_65)  # -> flatten(Length)
series_6 = Series(Start=0, Step=1, Count=lng_11)  # -> flatten(Series)
lng_12 = ListLength(List=data_65)  # -> flatten(Length)
partition = PartitionList(List=lng_12, Size=lng_8)
ma = MassAddition(Input=partition)  # -> flatten(Result), PartialResults
partition_2 = PartitionList(List=series_6, Size=ma.Result)
panel_35 = Panel(partition)
dispatch_19 = Dispatch(List=data_65, DispatchPattern=equals_9.Equality)  # -> ListA, ListB
line_6 = Line(dispatch_19.ListA)
line_7 = Line(line_5)

# ---- group: matchNeighb ID
txt_17 = Text(tb_22)

# ----
bs_5 = BranchCount(String=txt_17)
series_7 = Series(Start=0, Step=1, Count=bs_5)

keysearch_13 = KeyValueSearch(Keys=data_28, Values=data_61, Search=int_7)
move_8 = Move(Geometry=pt_45, Motion=Z_9)  # -> Geometry, Transform
tag_9 = TextTag(Location=move_8.Geometry, Text=data_19, Colour=ColourSwatch(SwatchColor=RGB(0, 0, 0)))

# ---- group: matched Man ID
data_66 = Data(keysearch_13)

# ----
tb_24 = TreeBranch(DataTree=data_35, BranchIndex=data_66)  # -> simplify(Branch)
txt_18 = Text(tb_24)
panel_36 = Panel(txt_18)
bs_6 = BranchCount(String=txt_18)
series_8 = Series(Start=0, Step=1, Count=bs_6)

tb_25 = TreeBranch(DataTree=data_36, BranchIndex=data_66)  # -> simplify(Branch)
panel_38 = Panel(tb_25)
txt_19 = Text(tb_25)
keysearch_14 = KeyValueSearch(Keys=data_32, Values=geo_27, Search=txt_19)

# ---- group: amenity ID pt
pt_50 = Point(keysearch_14)

# ----
null_4 = NullItem(Item=pt_50)  # -> flatten(NullFlags), InvalidFlags, Description

move_9 = Move(Geometry=pt_50, Motion=Z_8)  # -> Geometry, Transform
tag_10 = TextTag(Location=move_9.Geometry, Text=data_66, Colour=ColourSwatch(SwatchColor=RGB(255, 0, 251)))
ln_6 = Line(StartPoint=graft(pt_45), EndPoint=pt_50)

dispatch_20 = Dispatch(List=data_27, DispatchPattern=null_4.NullFlags)  # -> ListA, ListB

# ---- group: empl - amenities
line_8 = Line(flatten(ln_6))

line_9 = Line(ln_6)

# ----
larger_2 = LargerThan(FirstNumber=line_8, SecondNumber=0.01)  # -> LargerThan, OrEqualTo
cull = CullPattern(List=line_8, CullPattern=larger_2.OrEqualTo)

ln_7 = Line(StartPoint=graft(pt_47), EndPoint=pt_27)
panel_39 = Panel(cull)

# ---- group: empl - amenity
line_10 = Line(flatten(ln_7))

# ----
end_2 = EndPoints(Curve=cull)  # -> Start, End
viewer_3 = ParamViewer(cull)
pt_51 = Point(end_2.Start)
pt_52 = Point(pt_51)
data_67 = Data(graft(cull))
lng_13 = ListLength(List=data_67)  # -> flatten(Length)

pdecon_10 = Deconstruct(Point=pt_52)  # -> XComponent, YComponent, ZComponent
sort_11 = SortList(Keys=pdecon_10.ZComponent)  # -> Keys, ValuesA
dcon_10 = DeleteConsecutive(Set=sort_11.Keys, Wrap=False)  # -> Set, Count
equals_10 = Equality(FirstNumber=pdecon_10.ZComponent, SecondNumber=graft(dcon_10.Set))  # -> Equality, Inequality
dispatch_21 = Dispatch(List=pt_52, DispatchPattern=equals_10.Equality)  # -> ListA, ListB
pt_53 = Point(simplify(dispatch_21.ListA))

data_68 = Data(pt_53)
series_9 = Series(Start=0, Step=1, Count=lng_13)  # -> flatten(Series)
lng_14 = ListLength(List=data_68)  # -> flatten(Length)
lng_15 = ListLength(List=data_67)  # -> flatten(Length)
partition_3 = PartitionList(List=lng_15, Size=lng_14)
ma_2 = MassAddition(Input=partition_3)  # -> flatten(Result), PartialResults
partition_4 = PartitionList(List=series_9, Size=ma_2.Result)
ma_3 = MassAddition(Input=ma_2.Result)  # -> flatten(Result), PartialResults
panel_40 = Panel(partition_3)
txt_20 = Text(tb_25)

keysearch_15 = KeyValueSearch(Keys=data_30, Values=data_62, Search=int_9)
move_10 = Move(Geometry=pt_46, Motion=Z_11)  # -> Geometry, Transform
tag_11 = TextTag(Location=move_10.Geometry, Text=data_20, Colour=ColourSwatch(SwatchColor=RGB(0, 0, 0)))

# ---- group: matched Man ID
data_69 = Data(keysearch_15)

# ----
tb_26 = TreeBranch(DataTree=data_6, BranchIndex=data_69)  # -> simplify(Branch)
panel_41 = Panel(tb_26)
txt_21 = Text(tb_26)
keysearch_16 = KeyValueSearch(Keys=data_33, Values=geo_29, Search=txt_21)

# ---- group: manager ID pt
pt_54 = Point(keysearch_16)

# ----
move_11 = Move(Geometry=pt_54, Motion=Z_10)  # -> Geometry, Transform
tag_12 = TextTag(Location=move_11.Geometry, Text=data_69, Colour=ColourSwatch(SwatchColor=RGB(255, 0, 251)))
ln_8 = Line(StartPoint=graft(pt_46), EndPoint=pt_54)

# ---- group: empl - amenities
line_11 = Line(flatten(ln_8))

# ---- group: empl - div manager
line_12 = Line(ln_8)

# ----
larger_3 = LargerThan(FirstNumber=line_11, SecondNumber=0.01)  # -> LargerThan, OrEqualTo
cull_2 = CullPattern(List=line_11, CullPattern=larger_3.OrEqualTo)

panel_42 = Panel(cull_2)

end_3 = EndPoints(Curve=cull_2)  # -> Start, End
viewer_4 = ParamViewer(cull_2)
pt_55 = Point(end_3.Start)
pt_56 = Point(pt_55)
data_70 = Data(graft(cull_2))
lng_16 = ListLength(List=data_70)  # -> flatten(Length)

pdecon_11 = Deconstruct(Point=pt_56)  # -> XComponent, YComponent, ZComponent
# import geometry by layer and branch items by floor
sort_12 = SortList(Keys=pdecon_11.ZComponent)  # -> Keys, ValuesA
dcon_11 = DeleteConsecutive(Set=sort_12.Keys, Wrap=False)  # -> Set, Count
equals_11 = Equality(FirstNumber=pdecon_11.ZComponent, SecondNumber=graft(dcon_11.Set))  # -> Equality, Inequality
dispatch_22 = Dispatch(List=pt_56, DispatchPattern=equals_11.Equality)  # -> ListA, ListB
pt_57 = Point(simplify(dispatch_22.ListA))

data_71 = Data(pt_57)
series_10 = Series(Start=0, Step=1, Count=lng_16)  # -> flatten(Series)
lng_17 = ListLength(List=data_71)  # -> flatten(Length)
lng_18 = ListLength(List=data_70)  # -> flatten(Length)
partition_5 = PartitionList(List=lng_18, Size=lng_17)
ma_4 = MassAddition(Input=partition_5)  # -> flatten(Result), PartialResults
partition_6 = PartitionList(List=series_10, Size=ma_4.Result)
ma_5 = MassAddition(Input=ma_4.Result)  # -> flatten(Result), PartialResults
panel_43 = Panel(partition_5)

ln_9 = Line(StartPoint=pt_47, EndPoint=pt_48)
move_12 = Move(Geometry=pt_48, Motion=Z_13)  # -> Geometry, Transform
tag_13 = TextTag(Location=move_12.Geometry, Text=data_63, Colour=ColourSwatch(SwatchColor=RGB(255, 0, 251)))

# ---- group: empl - managers
line_13 = Line(ln_9)

# ----
panel_44 = Panel(line_13)

# ---- group: Generate Base Grid
crv_12 = Curve(geo_13)
num_5 = Number(num_2)
dim = Dimensions(Surface=crv_12)  # -> UDimension, VDimension
division_2 = Division(A=dim.UDimension, B=num_5)
division_3 = Division(A=dim.VDimension, B=num_5)
sdivide = DivideSurface(Surface=crv_12, UCount=division_2, VCount=division_3)  # -> Points, Normals, Parameters

# ---- group: Create Combined Obstacle Geo
crv_13 = Curve(geo_12)
crv_14 = Curve(geo_14)
crv_15 = Curve(geo_18)
crv_16 = Curve(geo_15)
merge_3 = Merge(Data1=crv_13, Data2=crv_14, Data3=crv_15, Data4=crv_16, Data5=geo_16)
crv_17 = Curve(merge_3)

merge_4 = Merge(Data1=geo_13, Data2=crv_17, Data3=geo_11)
crv_18 = Curve(merge_4)

# ---- group: Connect All Space Vertices (NON FUNCTIONING & SLOW 25s+)
panel_45 = Panel("25")  # disabled
python_24 = PythonScript(spaces=crv_18, seekLimit=panel_45)  # -> out, outLn; inputs spaces: list of Curve; disabled
# ---------- python_24: Python ----------
import rhinoscriptsyntax as rs
import ghpythonlib.parallel as pl

verts = []
for space in spaces:
    verts.extend( rs.PolylineVertices(space) )

outLn = []

def makeCXN(pt):
    results = []
    idx = verts.index(pt)
    for i in range(idx, len(verts) ):
        if rs.Distance(pt, verts[i]) > 0 and rs.Distance(pt, verts[i]) < seekLimit:
            testLn = rs.AddLine(pt, verts[i])
            #if not checkX(testLn): results.append(testLn)
            results.append(testLn)
    return results

def checkX(ln):
    hit = False
    for space in spaces:
        result = rs.CurveCurveIntersection(ln, space)
        if result:
            if len(result) > 2:
                return True
    return False

outLn = pl.run(makeCXN, verts, True)
# ---------- end python_24 ----------
crv_19 = Curve(python_24.outLn)  # disabled
python_25 = PythonScript(lines=crv_19, spaces=crv_18)  # -> out, outLn; inputs lines: list of Curve, spaces: list of Curve; disabled
# ---------- python_25: Python ----------
import rhinoscriptsyntax as rs
import ghpythonlib.parallel as pl

def checkInt(ln):
    for space in spaces:
        if rs.CurveCurveIntersection(ln, space):
            result = rs.CurveCurveIntersection(ln, space)
            if result and len(result) > 2:
                    return True 
    return False

def checkX(ln):
    for space in spaces:
        result = rs.CurveCurveIntersection(ln, space)
        if result > 2: return True 
    return False

outLn = pl.run(checkInt, lines, True)
# ---------- end python_25 ----------

# ----
cls = Closed(Curve=crv_17)  # -> Closed, Periodic
trim_3 = TrimTree(Tree=sdivide.Points, Depth="2")
explode = Explode(Curve=crv_18, Recursive=True)  # -> Segments, Vertices
trim_4 = TrimTree(Tree=explode.Segments, Depth=1)
dupln = RemoveDuplicateLines(Lines=trim_4, Tolerance=0.01)
crv_20 = Curve(simplify(crv_18))
line_14 = Line(simplify(dupln))

# ---- group: Generate Base Grid (continued)
pt_58 = Point(trim_3)

# ---- group: Create Combined Obstacle Geo (continued)
dispatch_23 = Dispatch(List=crv_17, DispatchPattern=cls.Closed)  # -> ListA, ListB
crv_21 = Curve(dispatch_23.ListA)

# ----
tb_27 = TreeBranch(DataTree=pt_58, BranchIndex=0)

# ---- group: Clean Null Points
pt_59 = Point(pt_58)
null_5 = NullItem(Item=pt_59)  # -> NullFlags, InvalidFlags, Description
dispatch_24 = Dispatch(List=pt_59, DispatchPattern=null_5.NullFlags)  # -> ListA, ListB
pt_60 = Point(dispatch_24.ListB)

# ----
geo_32 = Geometry(tb_27)
dots_7 = DotDisplay(Point=geo_32, Colour=ColourSwatch(SwatchColor=RGB(133, 133, 133)), Size=Slider(10, range=0..10))

crv_22 = Curve(crv_21)

# ---- group: Limit points to circulation areas
python_26 = PythonScript(pts=pt_60, areas=crv_22, parallel=Toggle(True))  # -> out, outPt; inputs pts: list of Point3d, areas: list of Curve
# ---------- python_26: Python ----------
import rhinoscriptsyntax as rs
import ghpythonlib.parallel as pl

outPt = []

def inOut(pt):
    for area in areas:
        if rs.PointInPlanarClosedCurve(pt, area):
            return
    return pt

if parallel:
    output = pl.run(inOut, pts, True)
else:
    output = [inOut(item) for item in pts]

for item in output:
    if item:
        outPt.append(item)
# ---------- end python_26 ----------

# ---- group: Sampling Points
pt_61 = Point(simplify(python_26.outPt))

# ----
tb_28 = TreeBranch(DataTree=pt_61, BranchIndex=0)
geo_33 = Geometry(tb_28)
dots_8 = DotDisplay(Point=geo_33, Colour=ColourSwatch(SwatchColor=RGB(133, 133, 133)), Size=Slider(10, range=0..10))

merge_5 = Merge(Data1=pt_29, Data2=pt_30, Data3=pt_28, Data4=pt_61)
merge_6 = Merge(Data1=merge_5, Data2=pt_34)

# ---- group: Generate Interconnections
python_27 = PythonScript(pts=merge_6, areas=crv_17, lookDist=multiplication_2)  # -> out, outLn; inputs pts: list of Point3d, areas: list of Curve
# ---------- python_27: Python ----------
import rhinoscriptsyntax as rs
import ghpythonlib.parallel as pl

outPt = []

def makeCXN(pt):
    idx = pts.index(pt)
    neighbors = []
    lines = []
    for i in range(idx, len(pts)):
        if rs.Distance(pt, pts[i]) > 0 and rs.Distance(pt, pts[i]) <= lookDist:
            neighbors.append(pts[i])
    
    for item in neighbors:
        lines.append( rs.AddLine(pt, item) )
    
    return lines


outLn = pl.run(makeCXN, pts, True)
# ---------- end python_27 ----------
dupln_2 = RemoveDuplicateLines(Lines=python_27.outLn, Tolerance=0.01)

# ----
tb_29 = TreeBranch(DataTree=merge_6, BranchIndex=0)
geo_34 = Geometry(tb_29)
dots_9 = DotDisplay(Point=geo_34, Colour=ColourSwatch(SwatchColor=RGB(133, 133, 133)), Size=Slider(10, range=0..10))

line_15 = Line(simplify(dupln_2))
python_28 = PythonScript(lines=line_15, collision=crv_20, seekDist=multiplication_2)  # -> out, outLn; inputs lines: list of Curve, collision: list of Curve
# ---------- python_28: Python ----------
import rhinoscriptsyntax as rs
import ghpythonlib.parallel as pl

outLn = []

def checkIntersect(ln):
    hits = 0
    midPt = rs.CurveMidPoint(ln)
    
    for item in collision:
        if hits > 0:
            return
        result = rs.CurveCurveIntersection(ln, item)
        if result:
            hits += len(result)
    return ln



output = pl.run(checkIntersect, lines, True)

for item in output:
    if item:
        outLn.append(item)
# ---------- end python_28 ----------

tb_30 = TreeBranch(DataTree=dupln_2, BranchIndex=0)
geo_35 = Geometry(tb_30)
previewlw_3 = CustomPreviewLineweights(Geometry=geo_35, Shader=swatch, Thickness=number_slider_2)

python_29 = PythonScript(lines=line_15, collision=line_14)  # -> out, outLn; inputs lines: list of Line, collision: list of Line; disabled
# ---------- python_29: Python ----------
import rhinoscriptsyntax as rs
import ghpythonlib.parallel as pl

outLn = []

def checkIntersect(ln):
    hits = 0
    for item in collision:
        print hits
        if hits > 1:
            return
        result = rs.LineLineIntersection(ln, item)
        if result:
            result = rs.coerce3dpoint(result[0])
            if cp_dist == 0:
                hits += 1
    return ln



output = pl.run(checkIntersect, lines, True)

for item in output:
    if item:
        outLn.append(item)
# ---------- end python_29 ----------
crv_23 = Curve(python_28.outLn)

# ---- group: remove invalid edges / edges
crv_24 = Curve(flatten(crv_23))

# ----
tb_31 = TreeBranch(DataTree=crv_23, BranchIndex=Slider(0, range=0..2))
geo_36 = Geometry(tb_31)
geo_37 = Geometry(tb_31)
previewlw_4 = CustomPreviewLineweights(Geometry=geo_36, Shader=swatch, Thickness=number_slider_2)
previewlw_5 = CustomPreviewLineweights(Geometry=geo_37, Shader=ColourSwatch(SwatchColor=RGB(212, 212, 212)), Thickness=Slider(1.07, range=0.01..4))

# ---- group: remove invalid edges / edges
crv_25 = Curve(flatten(tb_31))

# ----
merge_7 = Merge(Data1=crv_6, Data2=crv_25)  # -> flatten(Result)

# ---- group: remove invalid edges
smaller = SmallerThan(FirstNumber=merge_7, SecondNumber=Slider(0.1, range=0..0.1))  # -> SmallerThan, OrEqualTo
dispatch_25 = Dispatch(List=merge_7, DispatchPattern=smaller.OrEqualTo)  # -> ListA, ListB
crv_26 = Curve(dispatch_25.ListA)
crv_27 = Curve(dispatch_25.ListB)

# ---- group: remove invalid edges / edges
line_16 = Line(crv_27)

# ---- group: calculate cost / edges
crv_28 = Curve(line_16)

# ---- group: remove invalid edges
merge_8 = Merge(Data1=crv_7, Data2=crv_24)  # -> flatten(Result)
smaller_2 = SmallerThan(FirstNumber=merge_8, SecondNumber=Slider(0.1, range=0..0.1))  # -> SmallerThan, OrEqualTo
dispatch_26 = Dispatch(List=merge_8, DispatchPattern=smaller_2.OrEqualTo)  # -> ListA, ListB
crv_29 = Curve(dispatch_26.ListA)
crv_30 = Curve(dispatch_26.ListB)

# ----
previewlw_6 = CustomPreviewLineweights(Geometry=crv_24, Shader=ColourSwatch(SwatchColor=RGB(212, 212, 212)), Thickness=Slider(1.07, range=0.01..4))

# ---- group: remove invalid edges / edges
line_17 = Line(crv_30)

# ---- group: calculate cost / edges
# assign cost to edges
crv_31 = Curve(line_17)

# ----
previewlw_7 = CustomPreviewLineweights(Geometry=crv_31, Shader=ColourSwatch(SwatchColor=RGB(168, 168, 168)))
curvepoint_4 = PointOnCurve(crv_31, parameter=0.5)

# ---- group: edges
crv_32 = Curve(crv_31)

crv_33 = Curve(crv_31)

crv_34 = Curve(crv_31)

crv_35 = Curve(crv_31)

crv_36 = Curve(crv_35)

crv_37 = Curve(crv_35)

crv_38 = Curve(crv_35)

crv_39 = Curve(crv_35)

crv_40 = Curve(crv_35)

# ---- group: calculate cost
end_4 = EndPoints(Curve=crv_28)  # -> Start, End
pdecon_12 = Deconstruct(Point=end_4.End)  # -> XComponent, YComponent, ZComponent
pdecon_13 = Deconstruct(Point=end_4.Start)  # -> XComponent, YComponent, ZComponent
subtraction = Subtraction(A=pdecon_13.ZComponent, B=pdecon_12.ZComponent)
abs = Absolute(Value=subtraction)
len = Length(Curve=crv_28)
panel_46 = Panel("l")

# ---- group: calculate cost / Length
data_72 = Data(len)

# ---- group: calculate cost (continued)
eval = Evaluate(F="l*(1+(z/f))", z=abs, f=Slider(0.761, range=0..3), l=data_72)
panel_47 = Panel(data_72)

# ---- group: calculate cost / cost
data_73 = Data(eval)

# ----
bnd = Bounds(Numbers=data_73)
dedomain = DeconstructDomain(Domain=bnd)  # -> Start, End
gradient = Gradient(
    LowerLimit=dedomain.Start,
    UpperLimit=dedomain.End,
    Parameter=data_73,
    stops=[0: RGB(234, 38, 0), 0.25: RGB(234, 126, 0), 0.5: RGB(254, 244, 84), 0.75: RGB(173, 203, 249), 1: RGB(75, 107, 169)])

# ---- group: calculate cost (continued)
panel_48 = Panel(data_73)

# ----
previewlw_8 = CustomPreviewLineweights(Geometry=crv_28, Shader=gradient, Thickness=Slider(3, range=0..10))

# ---- group: process nodes array
end_5 = EndPoints(Curve=line_17)  # -> Start, End
rdpoints_2 = RemoveDuplicatePointsKaramba(Point=flatten([end_5.Start, end_5.End]), LDist=0.005)  # -> OutPoint, Info, Indexes

# ---- group: process nodes array / nodes
pt_62 = Point(rdpoints_2.OutPoint)

# ---- group: nodes
pt_63 = Point(pt_62)  # disabled

# ---- group: max shortest path
crv_41 = Curve(tb_23)

# ----
end_6 = EndPoints(Curve=crv_41)  # -> Start, End
dots_10 = DotDisplay(Point=end_6.Start, Colour=ColourSwatch(SwatchColor=RGB(255, 0, 0)), Size=number_slider_3)
dots_11 = DotDisplay(Point=end_6.End, Colour=ColourSwatch(SwatchColor=RGB(51, 255, 0)), Size=number_slider_3)

# ---- group: calculate cost
end_7 = EndPoints(Curve=crv_31)  # -> Start, End
pdecon_14 = Deconstruct(Point=end_7.End)  # -> XComponent, YComponent, ZComponent
pdecon_15 = Deconstruct(Point=end_7.Start)  # -> XComponent, YComponent, ZComponent
subtraction_2 = Subtraction(A=pdecon_15.ZComponent, B=pdecon_14.ZComponent)
abs_2 = Absolute(Value=subtraction_2)
len_2 = Length(Curve=crv_31)
panel_50 = Panel("l*(1+(z/h)*f)")

# ---- group: calculate cost / Length
data_74 = Data(len_2)

# ----
panel_51 = Panel(abs_2)

# ---- group: process nodes array (continued)
lng_19 = ListLength(List=pt_62)
series_11 = Series(Start=0, Step=1, Count=lng_19)
int_12 = Integer(series_11)

# ----
concat = Concatenate(FragmentA="node", FragmentB=int_12)

# ---- group: process nodes array (continued)
python_30 = PythonScript(nodes=pt_62, IDs=concat)  # -> out, points; inputs nodes: list, IDs: list
# ---------- python_30: Python ----------
import rhinoscriptsyntax as rs
import json

#print nodes
nCoord = []
for i in range(len(nodes)):
    pX = (rs.coerce3dpoint(nodes[i])).X
    pY = (rs.coerce3dpoint(nodes[i])).Y
    pZ = (rs.coerce3dpoint(nodes[i])).Z
    
    nCoord.append((pX,pY,pZ))
    
#print nCoord

points = zip(IDs, nCoord)

dict_ID = {}

for IDs, nCoord in points:
    dict_ID[IDs] = nCoord
format = "dictionary > {IDnn: 'x,y,z'}"
print format
print dict_ID

dict_ID = json.dumps(dict_ID)

points = dict_ID
# ---------- end python_30 ----------

# ----
tag_14 = TextTag3D(
    Location=pt_62,
    Text=concat,
    Size=Slider(2.4, range=0.1..5),
    Colour=ColourSwatch(SwatchColor=RGB(0, 0, 0)),
    Justification=7)
panel_52 = Panel(python_30.points)

# ---- group: calculate cost (continued)
eval_2 = Evaluate(F=panel_50, z=abs_2, h=floor_height_or_ave_fl_fl_height, l=data_74, f=number_slider_4)
panel_53 = Panel(data_74)

# ---- group: calculate cost / cost
data_75 = Data(eval_2)

# ---- group: max shortest path (continued)
shortwalk = ShortestWalk(Curves=crv_31, Lengths=data_75, WantedPath=crv_41)  # -> ShortestWalk, Succession, Direction, Length

# ----
crv_42 = Curve(shortwalk.ShortestWalk)
move_13 = Move(Geometry=crv_42, Motion=Z)  # -> Geometry, Transform
previewlw_9 = CustomPreviewLineweights(Geometry=move_13.Geometry, Shader=swatch_2, Thickness=Slider(10, range=0..10))

# ---- group: calculate cost (continued)
panel_54 = Panel(data_75)

# ----
python_31 = PythonScript(file=path_3, edges=crv_31, cost=data_75)  # -> out, lines, myTuple; inputs edges: list, cost: list
# ---------- python_31: Python ----------
import rhinoscriptsyntax as rs
import json
#import csv

startPts = []
endPts = []

#print cost

for edge in edges:
    p0 = rs.CurveEndPoint(edge)
    p1 = rs.CurveStartPoint(edge)
    startPts.append((p0.X, p0.Y, p0.Z))
    endPts.append((p1.X, p1.Y, p1.Z))

print len(startPts)
myTuple = zip(startPts, endPts)
#print myTuple

jsonSrc = file
with open(jsonSrc, mode='w') as outfile:
    json.dump( myTuple, outfile, indent=4, separators=(',', ': ') )

f = open('lines.txt', 'w')
print f
for t in myTuple:
    print t
    print 'i////'
for t in myTuple:
  f.write(''.join(str(t)) + '\n')

f.close()
# ---------- end python_31 ----------

# ---- group: max shortest path
crv_43 = Curve(<curve referenced from the Rhino model>)
shortwalk_2 = ShortestWalk(Curves=crv_31, Lengths=data_75, WantedPath=crv_43)  # -> ShortestWalk, Succession, Direction, Length

# ----
panel_55 = Panel(python_31.myTuple)
end_8 = EndPoints(Curve=crv_43)  # -> Start, End

# ---- group: cost
data_76 = Data(eval_2)

# ----
previewlw_10 = CustomPreviewLineweights(Geometry=shortwalk_2.ShortestWalk, Shader=swatch_2, Thickness=Slider(6, range=0..10))
tag_15 = TextTag3D(
    Location=curvepoint_4,
    Text=data_75,
    Size=Slider(0.241, range=0..1),
    Colour=ColourSwatch(SwatchColor=RGB(0, 0, 0)),
    Justification=7)
dots_12 = DotDisplay(Point=end_8.Start, Colour=ColourSwatch(SwatchColor=RGB(255, 0, 0)), Size=number_slider_6)
dots_13 = DotDisplay(Point=end_8.End, Colour=ColourSwatch(SwatchColor=RGB(51, 255, 0)), Size=number_slider_6)

# ---- group: cost
data_77 = Data(data_75)

data_78 = Data(data_75)

data_79 = Data(data_75)

data_80 = Data(data_75)

# ----
python_32 = PythonScript(edges=crv_31, cost=data_75)  # -> out, lines, format; inputs edges: list, cost: list; disabled
# ---------- python_32: Python ----------
import rhinoscriptsyntax as rs
import json

startPts = []
endPts = []

print cost

for edge in edges:
    p0 = rs.CurveEndPoint(edge)
    p1 = rs.CurveStartPoint(edge)
    startPts.append((p0.X, p0.Y, p0.Z))
    endPts.append((p1.X, p1.Y, p1.Z))


myTuple = zip(startPts, endPts, cost)

dict_Cost = []
for startPts, endPts, cost in myTuple:
    dict_Cost.append((startPts, endPts, cost))
format = "dictionary > {Edge Index: ('x1, y1, z1', 'x2, y2, z2', 'cost')}"
print format
print dict_Cost

dict_Cost = json.dumps(dict_Cost)

lines = dict_Cost
# ---------- end python_32 ----------
panel_57 = Panel(python_32.format)

line_18 = Line(line_9)
shortwalk_3 = ShortestWalk(Curves=crv_33, Lengths=data_78, WantedPath=line_18)  # -> ShortestWalk, Succession, Direction, Length
data_81 = Data(flatten(shortwalk_3.Succession))
clean_4 = CleanTree(RemoveNulls=True, RemoveInvalid=True, RemoveEmpty=False, Tree=shortwalk_3.ShortestWalk)
lng_20 = ListLength(List=shortwalk_3.Succession)
# shortest path + cost output
python_33 = PythonScript(edgeIndexes=flatten(shortwalk_3.Succession), costs=data_78)  # -> out, totalCost; inputs edgeIndexes: list, costs: list
# ---------- python_33: Python ----------
totalCost = []

for i in edgeIndexes:
    totalCost.append(costs[i])

print totalCost
# ---------- end python_33 ----------
panel_58 = Panel(lng_20)
panel_59 = Panel(python_33.totalCost)
partition_7 = PartitionList(List=python_33.totalCost, Size=flatten(lng_20))
avr_2 = Average(Input=partition_7)  # -> flatten(ArithmeticMean)
panel_60 = Panel(partition_7)
panel_61 = Panel(shortwalk_3.Length)
number_slider_21 = Slider(1.97, range=0..2)

line_19 = Line(cull_2)
shortwalk_4 = ShortestWalk(Curves=crv_34, Lengths=data_79, WantedPath=line_19)  # -> ShortestWalk, Succession, Direction, Length
data_82 = Data(flatten(shortwalk_4.Succession))
clean_5 = CleanTree(RemoveNulls=True, RemoveInvalid=True, RemoveEmpty=False, Tree=shortwalk_4.ShortestWalk)
lng_21 = ListLength(List=shortwalk_4.Succession)
python_34 = PythonScript(edgeIndexes=flatten(shortwalk_4.Succession), costs=data_79)  # -> out, totalCost; inputs edgeIndexes: list, costs: list; same code as python_33
panel_62 = Panel(lng_21)
panel_63 = Panel(python_34.totalCost)
partition_8 = PartitionList(List=python_34.totalCost, Size=flatten(lng_21))
avr_3 = Average(Input=partition_8)  # -> flatten(ArithmeticMean)
panel_64 = Panel(partition_8)
panel_65 = Panel(shortwalk_4.Length)
number_slider_22 = Slider(1.97, range=0..2)

data_83 = Data(shortwalk_4.Length)

# ---- group: measure congestion
python_35 = PythonScript(x=data_81, y=crv_35, weight=data_78)  # -> out, occurr; inputs x: list, y: list, weight: list
# ---------- python_35: Python ----------
occurr = []
costList = []
for i in range(len(y)):
    
    val = x.count(i)
    occurr.append(val)
    costList.append(weight[i])
# ---------- end python_35 ----------

python_36 = PythonScript(x=data_82, y=crv_35, weight=data_79)  # -> out, occurr; inputs x: list, y: list, weight: list; same code as python_35

# ---- group: ave cost per shortest path
data_84 = Data(avr_2)

data_85 = Data(avr_3)

data_86 = Data(shortwalk_4.Length)

data_87 = Data(shortwalk_3.Length)

# ---- group: traffic per edge
data_88 = Data(python_35.occurr)

data_89 = Data(python_36.occurr)

# ---- group: visualize traffic
bnd_2 = Bounds(Numbers=data_88)
dedomain_2 = DeconstructDomain(Domain=bnd_2)  # -> Start, End
gradient_2 = Gradient(
    LowerLimit=dedomain_2.Start,
    UpperLimit=dedomain_2.End,
    Parameter=data_88,
    stops=[0: RGB(0, 128, 0), 0.5: RGB(255, 255, 0), 1: RGB(255, 0, 0)])
multiplication_8 = Multiplication(A=data_88, B=Slider(0.65, range=0..2))
previewlw_11 = CustomPreviewLineweights(Geometry=crv_36, Shader=gradient_2, Thickness=multiplication_8)

bnd_3 = Bounds(Numbers=data_87)
dedomain_3 = DeconstructDomain(Domain=bnd_3)  # -> Start, End
gradient_3 = Gradient(
    LowerLimit=dedomain_3.Start,
    UpperLimit=dedomain_3.End,
    Parameter=data_87,
    stops=[0: RGB(0, 128, 0), 0.5: RGB(255, 255, 0), 1: RGB(255, 0, 0)])
multiplication_9 = Multiplication(A=data_87, B=Slider(0.01, range=0..1))
previewlw_12 = CustomPreviewLineweights(Geometry=clean_4, Shader=gradient_3, Thickness=multiplication_9)

bnd_4 = Bounds(Numbers=data_89)
dedomain_4 = DeconstructDomain(Domain=bnd_4)  # -> Start, End
gradient_4 = Gradient(
    LowerLimit=dedomain_4.Start,
    UpperLimit=dedomain_4.End,
    Parameter=data_89,
    stops=[0: RGB(0, 128, 0), 0.5: RGB(255, 255, 0), 1: RGB(255, 0, 0)])
multiplication_10 = Multiplication(A=data_89, B=Slider(0.65, range=0..2))
previewlw_13 = CustomPreviewLineweights(Geometry=crv_38, Shader=gradient_4, Thickness=multiplication_10)

# ---- group: visualize shortest paths
Z_14 = UnitZ(Factor=Slider(0.596, range=0..1))
crv_44 = Curve(shortwalk_3.ShortestWalk)
move_14 = Move(Geometry=crv_44, Motion=Z_14)  # -> Geometry, Transform
previewlw_14 = CustomPreviewLineweights(Geometry=move_14.Geometry, Shader=ColourSwatch(SwatchColor=RGB(0, 183, 255)), Thickness=Slider(6, range=0..10))

# ---- group: visualize traffic
bnd_5 = Bounds(Numbers=data_86)
dedomain_5 = DeconstructDomain(Domain=bnd_5)  # -> Start, End
gradient_5 = Gradient(
    LowerLimit=dedomain_5.Start,
    UpperLimit=dedomain_5.End,
    Parameter=data_86,
    stops=[0: RGB(0, 128, 0), 0.5: RGB(255, 255, 0), 1: RGB(255, 0, 0)])
multiplication_11 = Multiplication(A=data_86, B=Slider(0.01, range=0..1))
previewlw_15 = CustomPreviewLineweights(Geometry=clean_5, Shader=gradient_5, Thickness=multiplication_11)

# ---- group: visualize shortest paths
Z_15 = UnitZ(Factor=Slider(0.596, range=0..1))
crv_45 = Curve(shortwalk_4.ShortestWalk)
move_15 = Move(Geometry=crv_45, Motion=Z_15)  # -> Geometry, Transform
previewlw_16 = CustomPreviewLineweights(Geometry=move_15.Geometry, Shader=ColourSwatch(SwatchColor=RGB(0, 183, 255)), Thickness=Slider(6, range=0..10))

# ---- group: use per edge
data_90 = Data(data_88)

# ----
larger_4 = LargerThan(FirstNumber=data_90, SecondNumber=Slider(1, range=0..3))  # -> LargerThan, OrEqualTo
dispatch_27 = Dispatch(List=crv_40, DispatchPattern=larger_4.OrEqualTo)  # -> ListA, ListB

# ---- group: use per edge
data_91 = Data(data_89)

# ----
larger_5 = LargerThan(FirstNumber=data_91, SecondNumber=Slider(1, range=0..3))  # -> LargerThan, OrEqualTo
dispatch_28 = Dispatch(List=crv_40, DispatchPattern=larger_5.OrEqualTo)  # -> ListA, ListB

data_92 = Data(shortwalk_3.Length)
null_6 = NullItem(Item=data_92)  # -> flatten(NullFlags), InvalidFlags, Description
data_93 = Data(shortwalk_2.Length)

# ---- group: adj -
crv_46 = Curve(dispatch_27.ListA)

# ----
clean_6 = CleanTree(RemoveNulls=True, RemoveInvalid=True, RemoveEmpty=True, Tree=data_92)  # -> flatten(Tree)

# ---- group: adj -
crv_47 = Curve(dispatch_28.ListA)

# ----
data_94 = Data(flatten(data_93))
data_95 = Data(shortwalk_3.Length)

# ---- group: normalize cost / cost
data_96 = Data(flatten(shortwalk_4.Length))

data_97 = Data(flatten(shortwalk_3.Length))

# ----
ma_6 = MassAddition(Input=data_92)  # -> flatten(Result), PartialResults

# ---- group: normalize cost / cost
data_98 = Data(flatten(shortwalk_4.Length))

# ----
partition_9 = PartitionList(List=data_98, Size=ma_4.Result)
partition_10 = PartitionList(List=data_96, Size=ma_4.Result)

# ---- group: adj -
crv_48 = Curve(dispatch_28.ListA)

crv_49 = Curve(dispatch_27.ListA)

# ----
data_99 = Data(flatten(shortwalk_3.Length))
partition_11 = PartitionList(List=data_99, Size=ma_2.Result)

line_20 = Line(line_13)
shortwalk_5 = ShortestWalk(Curves=crv_35, Lengths=data_80, WantedPath=line_20)  # -> ShortestWalk, Succession, Direction, Length
data_100 = Data(flatten(shortwalk_5.Succession))
lng_22 = ListLength(List=shortwalk_5.Succession)
clean_7 = CleanTree(RemoveNulls=True, RemoveInvalid=True, RemoveEmpty=False, Tree=shortwalk_5.ShortestWalk)
python_37 = PythonScript(edgeIndexes=flatten(shortwalk_5.Succession), costs=data_80)  # -> out, totalCost; inputs edgeIndexes: list, costs: list; same code as python_33
panel_66 = Panel(python_37.totalCost)
partition_12 = PartitionList(List=python_37.totalCost, Size=flatten(lng_22))
avr_4 = Average(Input=partition_12)  # -> flatten(ArithmeticMean)
panel_67 = Panel(partition_12)

# ---- group: measure congestion
python_38 = PythonScript(x=data_100, y=crv_35, weight=data_80)  # -> out, occurr; inputs x: list, y: list, weight: list; same code as python_35

# ---- group: ave cost per shortest path
data_101 = Data(avr_4)

# ----
panel_68 = Panel(data_101)

# ---- group: ave cost per shortest path
data_102 = Data(data_101)

# ---- group: traffic per edge
data_103 = Data(python_38.occurr)

# ---- group: visualize traffic
bnd_6 = Bounds(Numbers=data_103)
dedomain_6 = DeconstructDomain(Domain=bnd_6)  # -> Start, End
gradient_6 = Gradient(
    LowerLimit=dedomain_6.Start,
    UpperLimit=dedomain_6.End,
    Parameter=data_103,
    stops=[0: RGB(0, 128, 0), 0.5: RGB(255, 255, 0), 1: RGB(255, 0, 0)])
multiplication_12 = Multiplication(A=python_38.occurr, B=Slider(2, range=1..2))
previewlw_17 = CustomPreviewLineweights(Geometry=crv_39, Shader=gradient_6, Thickness=multiplication_12)

bnd_7 = Bounds(Numbers=data_102)
dedomain_7 = DeconstructDomain(Domain=bnd_7)  # -> Start, End
gradient_7 = Gradient(
    LowerLimit=dedomain_7.Start,
    UpperLimit=dedomain_7.End,
    Parameter=data_102,
    stops=[0: RGB(0, 128, 0), 0.5: RGB(255, 255, 0), 1: RGB(255, 0, 0)])
multiplication_13 = Multiplication(A=data_102, B=Slider(0.01, range=0..1))
previewlw_18 = CustomPreviewLineweights(Geometry=clean_7, Shader=gradient_7, Thickness=multiplication_13)

# ---- group: visualize shortest paths
Z_16 = UnitZ(Factor=Slider(0.596, range=0..1))
crv_50 = Curve(shortwalk_5.ShortestWalk)
move_16 = Move(Geometry=crv_50, Motion=Z_16)  # -> Geometry, Transform
previewlw_19 = CustomPreviewLineweights(Geometry=move_16.Geometry, Shader=ColourSwatch(SwatchColor=RGB(0, 183, 255)), Thickness=Slider(6, range=0..10))

# ---- group: use per edge
data_104 = Data(data_103)

# ----
larger_6 = LargerThan(FirstNumber=data_104, SecondNumber=Slider(1, range=0..3))  # -> LargerThan, OrEqualTo
dispatch_29 = Dispatch(List=crv_40, DispatchPattern=larger_6.OrEqualTo)  # -> ListA, ListB

# ---- group: normalize cost / cost
data_105 = Data(flatten(shortwalk_5.Length))

# ---- group: adj -
crv_51 = Curve(dispatch_29.ListA)

# ----
larger_7 = LargerThan(FirstNumber=data_103, SecondNumber=Slider(1, range=0..5))  # -> LargerThan, OrEqualTo
dispatch_30 = Dispatch(List=crv_40, DispatchPattern=larger_7.LargerThan)  # -> ListA, ListB
crv_52 = Curve(dispatch_30.ListA)
crv_53 = Curve(crv_52)
tb_32 = TreeBranch(DataTree=crv_53, BranchIndex=0)
join = JoinCurves(Curves=crv_53, Preserve=False)
curvepoint_5 = PointOnCurve(join, parameter=0.65)
pt_64 = Point(curvepoint_5)

# ---- group: Branch Pts Per Floor
cluster_2 = Cluster(pt=pt_64)  # -> bool_2, pt_4

# ----
crv_54 = Curve(join)
pt_65 = Point(simplify(cluster_2.pt_4))
bool_6 = Boolean(cluster_2.bool_2)
dispatch_31 = Dispatch(List=crv_54, DispatchPattern=bool_6)  # -> ListA, ListB
crv_55 = Curve(dispatch_31.ListA)
tb_33 = TreeBranch(DataTree=crv_55, BranchIndex=number_slider_10)
previewlw_20 = CustomPreviewLineweights(Geometry=tb_33, Shader=ColourSwatch(SwatchColor=RGB(161, 161, 161)), Thickness=Slider(10, range=0.1..10))
divlength_2 = DivideLength(Curve=tb_33, Length=number_slider_9)  # -> Points, Tangents, Parameters
curvepoint_6 = PointOnCurve(crv_53, parameter=0.5)
pt_66 = Point(flatten(divlength_2.Points))
divlength_3 = DivideLength(Curve=join, Length=number_slider_9)  # -> Points, Tangents, Parameters
pt_67 = Point(curvepoint_6)
pt_68 = Point(flatten(divlength_3.Points))

# ---- group: branch by floor
pdecon_16 = Deconstruct(Point=pt_68)  # -> XComponent, YComponent, ZComponent
sort_13 = SortList(Keys=pdecon_16.ZComponent)  # -> Keys, ValuesA
dcon_12 = DeleteConsecutive(Set=sort_13.Keys, Wrap=False)  # -> Set, Count
equals_12 = Equality(FirstNumber=pdecon_16.ZComponent, SecondNumber=graft(dcon_12.Set))  # -> Equality, Inequality
dispatch_32 = Dispatch(List=pt_68, DispatchPattern=equals_12.Equality)  # -> ListA, ListB
pt_69 = Point(simplify(dispatch_32.ListA))

pdecon_17 = Deconstruct(Point=pt_67)  # -> XComponent, YComponent, ZComponent
sort_14 = SortList(Keys=pdecon_17.ZComponent)  # -> Keys, ValuesA
dcon_13 = DeleteConsecutive(Set=sort_14.Keys, Wrap=False)  # -> Set, Count
equals_13 = Equality(FirstNumber=pdecon_17.ZComponent, SecondNumber=graft(dcon_13.Set))  # -> Equality, Inequality
dispatch_33 = Dispatch(List=crv_53, DispatchPattern=equals_13.Equality)  # -> ListA, ListB
pt_70 = Point(simplify(dispatch_33.ListA))

# ----
crv_56 = Curve(dispatch_33.ListA)
lng_23 = ListLength(List=pt_69)
bs_7 = BranchCount(String=lng_23)
tb_34 = TreeBranch(DataTree=crv_56, BranchIndex=0)
larger_8 = LargerThan(FirstNumber=flatten(lng_23), SecondNumber="1")  # -> LargerThan, OrEqualTo
series_12 = Series(Start=0, Step=1, Count=bs_7)
dispatch_34 = Dispatch(List=series_12, DispatchPattern=larger_8.LargerThan)  # -> ListA, ListB
tb_35 = TreeBranch(DataTree=pt_69, BranchIndex=dispatch_34.ListA)
pt_71 = Point(simplify(tb_35))
python_39 = PythonScript(circPts=pt_71, windPts=pt_13)  # -> out, lines; inputs circPts: list of Point3d, windPts: list of Point3d
# ---------- python_39: Python ----------
import rhinoscriptsyntax as rs

lines = []

for i in range(len(circPts)):
    
    myPt = circPts[i]
    
    for j in range(len(windPts)):
        
        myWindPt = windPts[j]
        if rs.Distance(myPt, myWindPt) > 0 and rs.Distance(myPt, myWindPt) <= 500:
            lines.append(rs.AddLine(myPt, myWindPt))
# ---------- end python_39 ----------
line_21 = Line(simplify(python_39.lines))
null_7 = NullItem(Item=line_21)  # -> NullFlags, InvalidFlags, Description
dispatch_35 = Dispatch(List=line_21, DispatchPattern=null_7.NullFlags)  # -> ListA, ListB
line_22 = Line(simplify(dispatch_35.ListB))

# ---- group: Remove Intersecting Edges
python_40 = PythonScript(lines=line_22, collision=crv_10, parallel=Toggle(True))  # -> out, outLn; inputs lines: list of Curve, collision: list of Curve; same code as python_23

# ----
crv_57 = Curve(python_40.outLn)
end_9 = EndPoints(Curve=crv_57)  # -> Start, End
tb_36 = TreeBranch(DataTree=crv_57, BranchIndex=number_slider_10)
pt_72 = Point(end_9.Start)
lng_24 = ListLength(List=crv_57)
lng_25 = ListLength(List=line_22)
previewlw_21 = CustomPreviewLineweights(Geometry=tb_36, Shader=ColourSwatch(SwatchColor=RGB(186, 186, 186)), Thickness=Slider(0.7, range=0.1..3))
rdpoints_3 = RemoveDuplicatePointsKaramba(Point=pt_72, LDist=0.005)  # -> OutPoint, Info, Indexes
previewlw_22 = CustomPreviewLineweights(Geometry=tb_34, Shader=ColourSwatch(SwatchColor=RGB(0, 115, 255)), Thickness=number_slider_12)
lng_26 = ListLength(List=pt_71)

# ---- group: Remaining View Rays
data_106 = Data(lng_24)

# ---- group: Total View Rays
data_107 = Data(lng_25)

# ----
lng_27 = ListLength(List=rdpoints_3.OutPoint)
panel_69 = Panel(data_106)
panel_70 = Panel(lng_27)
panel_71 = Panel(data_107)

# ---- group: tot # of sample nodes
data_108 = Data(lng_26)

# ----
division_4 = Division(A=lng_27, B=data_108)
tb_37 = TreeBranch(DataTree=pt_71, BranchIndex=number_slider_10)
multiplication_14 = Multiplication(A=division_4, B=10)
trim_5 = TrimTree(Tree=rdpoints_3.OutPoint, Depth=0)
tb_38 = TreeBranch(DataTree=trim_5, BranchIndex=number_slider_10)

# ---- group: True
data_109 = Data(tb_38)

# ----
avr_5 = Average(Input=flatten(multiplication_14))
division_5 = Division(A=data_106, B=data_107)
multiplication_15 = Multiplication(A=division_5, B="10")
dots_14 = DotDisplay(Point=tb_38, Colour=ColourSwatch(SwatchColor=RGB(255, 128, 128)), Size=number_slider_14)

# ---- group: %View to Outside per Floor
data_110 = Data(multiplication_15)

# ----
panel_72 = Panel(data_110)
move_17 = Move(Geometry=tb_37, Motion=Z_3)  # -> Geometry, Transform
dots_15 = DotDisplay(Point=move_17.Geometry, Colour=ColourSwatch(SwatchColor=RGB(0, 144, 255)), Size=number_slider_14)
avr_6 = Average(Input=flatten(data_110))

# ---- group: Global View to Outside
# n of Sample Pt w/ at least one ray / Tot n of Sample Rays
data_111 = Data(avr_5)

data_112 = Data(avr_6)

# ----
panel_73 = Panel(data_111)
panel_74 = Panel(data_112)
avr_7 = Average(Input=[data_55, data_111])
panel_75 = Panel(avr_7)
panel_76 = Panel(multiplication_14)
merge_9 = Merge(Data1=panel_76, Data2=panel_27)
panel_77 = Panel(avr_5)
num_6 = Number(merge_9)
avr_8 = Average(Input=num_6)
panel_78 = Panel(avr_8)

line_23 = Line(line_5)
shortwalk_6 = ShortestWalk(Curves=crv_32, Lengths=data_77, WantedPath=line_23)  # -> ShortestWalk, Succession, Direction, Length
data_113 = Data(flatten(shortwalk_6.Succession))
clean_8 = CleanTree(RemoveNulls=True, RemoveInvalid=True, RemoveEmpty=False, Tree=shortwalk_6.ShortestWalk)
python_41 = PythonScript(edgeIndexes=flatten(shortwalk_6.Succession), costs=data_77)  # -> out, totalCost; inputs edgeIndexes: list, costs: list; same code as python_33
lng_28 = ListLength(List=shortwalk_6.Succession)
panel_79 = Panel(shortwalk_6.Length)
panel_80 = Panel(python_41.totalCost)
partition_13 = PartitionList(List=python_41.totalCost, Size=flatten(lng_28))
avr_9 = Average(Input=partition_13)  # -> flatten(ArithmeticMean)
panel_81 = Panel(partition_13)
number_slider_23 = Slider(1.97, range=0..2)

end_10 = EndPoints(Curve=line_23)  # -> Start, End
sort_15 = SortList(Keys=flatten(lng_28), ValuesA=flatten(shortwalk_6.ShortestWalk))  # -> Keys, ValuesA
dots_16 = DotDisplay(Point=end_10.Start, Colour=ColourSwatch(SwatchColor=RGB(255, 0, 0)), Size=number_slider_3)
dots_17 = DotDisplay(Point=end_10.End, Colour=ColourSwatch(SwatchColor=RGB(51, 255, 0)), Size=number_slider_3)
lng_29 = ListLength(List=line_23)  # -> flatten(Length)
item_8 = ListItem(List=sort_15.ValuesA, Index=0, Wrap=True)

# ---- group: measure congestion
python_42 = PythonScript(x=data_113, y=crv_35, weight=data_77)  # -> out, occurr; inputs x: list, y: list, weight: list; same code as python_35

# ----
ma_7 = MassAddition(Input=partition_13)  # -> Result, PartialResults

# ---- group: ave cost per shortest path
data_114 = Data(avr_9)

# ----
panel_82 = Panel(ma_7.Result)

# ---- group: ave cost per shortest path
data_115 = Data(data_114)

# ---- group: traffic per edge
data_116 = Data(python_42.occurr)

# ---- group: visualize traffic
bnd_8 = Bounds(Numbers=data_116)
dedomain_8 = DeconstructDomain(Domain=bnd_8)  # -> Start, End
gradient_8 = Gradient(
    LowerLimit=dedomain_8.Start,
    UpperLimit=dedomain_8.End,
    Parameter=data_116,
    stops=[0: RGB(0, 128, 0), 0.5: RGB(255, 255, 0), 1: RGB(255, 0, 0)])
multiplication_16 = Multiplication(A=data_116, B=Slider(0.48, range=0..2))
previewlw_23 = CustomPreviewLineweights(Geometry=crv_37, Shader=gradient_8, Thickness=multiplication_16)

bnd_9 = Bounds(Numbers=data_115)
dedomain_9 = DeconstructDomain(Domain=bnd_9)  # -> Start, End
gradient_9 = Gradient(
    LowerLimit=dedomain_9.Start,
    UpperLimit=dedomain_9.End,
    Parameter=data_115,
    stops=[0: RGB(0, 128, 0), 0.5: RGB(255, 255, 0), 1: RGB(255, 0, 0)])
multiplication_17 = Multiplication(A=data_115, B=Slider(0.01, range=0..1))
previewlw_24 = CustomPreviewLineweights(Geometry=clean_8, Shader=gradient_9, Thickness=multiplication_17)

# ---- group: visualize shortest paths
Z_17 = UnitZ(Factor=Slider(0.596, range=0..1))
crv_58 = Curve(shortwalk_6.ShortestWalk)
move_18 = Move(Geometry=crv_58, Motion=Z_17)  # -> Geometry, Transform
previewlw_25 = CustomPreviewLineweights(Geometry=move_18.Geometry, Shader=ColourSwatch(SwatchColor=RGB(0, 183, 255)), Thickness=Slider(6, range=0..10))

# ----
end_11 = EndPoints(Curve=move_18.Geometry)  # -> Start, End
pt_73 = Point(flatten(end_11.Start))
pt_74 = Point(pt_73)

pdecon_18 = Deconstruct(Point=pt_74)  # -> XComponent, YComponent, ZComponent
sort_16 = SortList(Keys=pdecon_18.ZComponent)  # -> Keys, ValuesA
dcon_14 = DeleteConsecutive(Set=sort_16.Keys, Wrap=False)  # -> Set, Count
equals_14 = Equality(FirstNumber=pdecon_18.ZComponent, SecondNumber=graft(dcon_14.Set))  # -> Equality, Inequality
dispatch_36 = Dispatch(List=pt_74, DispatchPattern=equals_14.Equality)  # -> ListA, ListB
pt_75 = Point(simplify(dispatch_36.ListA))

dispatch_37 = Dispatch(List=flatten(move_18.Geometry), DispatchPattern=equals_14.Equality)  # -> ListA, ListB
crv_59 = Curve(dispatch_37.ListA)
tb_39 = TreeBranch(DataTree=pt_75, BranchIndex=number_slider_5)
tb_40 = TreeBranch(DataTree=crv_59, BranchIndex=number_slider_5)
dots_18 = DotDisplay(Point=tb_39, Colour=ColourSwatch(SwatchColor=RGB(255, 0, 0)), Size=Slider(13, range=0..30))
previewlw_26 = CustomPreviewLineweights(Geometry=tb_40, Shader=ColourSwatch(SwatchColor=RGB(0, 183, 255)), Thickness=Slider(6, range=0..10))
data_117 = Data(shortwalk_6.Length)
null_8 = NullItem(Item=data_117)  # -> flatten(NullFlags), InvalidFlags, Description

# ---- group: use per edge
data_118 = Data(data_116)

# ----
larger_9 = LargerThan(FirstNumber=data_118, SecondNumber=Slider(1, range=0..3))  # -> LargerThan, OrEqualTo
dispatch_38 = Dispatch(List=crv_40, DispatchPattern=larger_9.OrEqualTo)  # -> ListA, ListB

bs_8 = BranchCount(String=crv_58)

# ---- group: normalize cost / cost
data_119 = Data(flatten(shortwalk_6.Length))

# ----
bs_9 = BranchCount(String=crv_58)
clean_9 = CleanTree(RemoveNulls=True, RemoveInvalid=True, RemoveEmpty=True, Tree=data_117)  # -> flatten(Tree)
series_13 = Series(Start=0, Step=1, Count=bs_8)
series_14 = Series(Start=0, Step=1, Count=bs_9)

# ---- group: adj -
crv_60 = Curve(dispatch_38.ListA)

# ----
ma_8 = MassAddition(Input=data_117)  # -> flatten(Result), PartialResults
sort_17 = SortList(Keys=data_119)  # -> Keys, ValuesA
data_120 = Data(shortwalk_6.Length)
data_121 = Data(shortwalk_6.Length)
sort_18 = SortList(Keys=ma_8.Result, ValuesA=txt_5, ValuesC=series_7, ValuesD=series_13)  # -> Keys, ValuesA, ValuesB, ValuesC, ValuesD
sort_19 = SortList(Keys=ma_6.Result, ValuesA=txt_6, ValuesC=series_8, ValuesD=series_14)  # -> Keys, ValuesA, ValuesB, ValuesC, ValuesD
data_122 = Data(data_120)
lng_30 = ListLength(List=data_122)  # -> flatten(Length)
item_9 = ListItem(List=reverse(sort_17.Keys), Index=0, Wrap=True)
data_123 = Data(data_121)
lng_31 = ListLength(List=data_123)  # -> flatten(Length)

# ---- group: adj -
crv_61 = Curve(dispatch_38.ListA)

# ----
tb_41 = TreeBranch(DataTree=crv_58, BranchIndex=sort_18.ValuesD)  # -> simplify(Branch)
tb_42 = TreeBranch(DataTree=txt_17, BranchIndex=sort_18.ValuesC)  # -> simplify(Branch)
tb_43 = TreeBranch(DataTree=txt_18, BranchIndex=sort_19.ValuesC)  # -> simplify(Branch)
series_15 = Series(Start=0, Step=1, Count=lng_30)  # -> flatten(Series)
tb_44 = TreeBranch(DataTree=crv_58, BranchIndex=sort_19.ValuesD)  # -> simplify(Branch)
data_124 = Data(flatten(data_120))
series_16 = Series(Start=0, Step=1, Count=lng_31)  # -> flatten(Series)
data_125 = Data(flatten(data_121))
panel_83 = Panel(item_9)
entwine_2 = Entwine(Branch00=crv_49, Branch01=crv_48, Branch02=crv_61, FlattenInputs=True)
lng_32 = ListLength(List=data_122)  # -> flatten(Length)
item_10 = ListItem(List=sort_19.Keys, Index=Slider(193, range=0..1000), Wrap=True)
lng_33 = ListLength(List=data_123)  # -> flatten(Length)
cost = Panel(sort_18.Keys)
item_11 = ListItem(List=sort_19.ValuesA, Index=number_slider_8, Wrap=True)
tb_45 = TreeBranch(DataTree=tb_43, BranchIndex=number_slider_8)
panel_84 = Panel(item_10)
panel_85 = Panel(item_11)
partition_14 = PartitionList(List=lng_32, Size=lng_9)
panel_86 = Panel(tb_45)
partition_15 = PartitionList(List=lng_33, Size=lng_10)
tb_46 = TreeBranch(DataTree=tb_41, BranchIndex=Slider(157, range=0..1000))

# ---- group: normalize cost / cost
data_126 = Data(flatten(sort_18.Keys))

# ----
empl_id = Panel(sort_18.ValuesA)
ma_9 = MassAddition(Input=partition_14)  # -> flatten(Result), PartialResults
cost_2 = Panel(sort_19.Keys)
ma_10 = MassAddition(Input=ma_9.Result)  # -> flatten(Result), PartialResults
tb_47 = TreeBranch(DataTree=tb_44, BranchIndex=Slider(157, range=0..1000))
ma_11 = MassAddition(Input=partition_15)  # -> flatten(Result), PartialResults
partition_16 = PartitionList(List=data_124, Size=ma_9.Result)
partition_17 = PartitionList(List=data_125, Size=ma_11.Result)
panel_87 = Panel(partition_16)
neighb_id = Panel(tb_42)
data_127 = Data(partition_16)

# ---- group: normalize cost / cost
data_128 = Data(data_127)

# ----
panel_88 = Panel(partition_17)
data_129 = Data(partition_17)

# ---- group: normalize cost / cost
data_130 = Data(data_129)

# ----
empl_id_2 = Panel(sort_19.ValuesA)
avr_10 = Average(Input=data_127)
avr_11 = Average(Input=data_129)
panel_89 = Panel(avr_10)
amenity_id = Panel(tb_43)
panel_90 = Panel(avr_11)

data_131 = Data()  # disabled
data_132 = Data()  # disabled
number_slider_24 = Slider(5, range=0..254)  # disabled
number_slider_25 = Slider(24, range=0..254)  # disabled
number_slider_26 = Slider(78, range=0..254)  # disabled
number_slider_27 = Slider(80, range=0..254)  # disabled
item_12 = ListItem(List=pt_63, Index=number_slider_24, Wrap=True)  # disabled
number_slider_28 = Slider(1, range=0..1)  # disabled
number_slider_29 = Slider(0.596, range=0..1)  # disabled
number_slider_30 = Slider(10, range=0..10)  # disabled
Z_18 = UnitZ(Factor=number_slider_28)  # disabled
Z_19 = UnitZ(Factor=number_slider_29)  # disabled

int_13 = Integer(data_131)  # disabled
int_14 = Integer(data_132)  # disabled

item_13 = ListItem(List=pt_63, Index=int_14, Wrap=True)  # disabled
null_9 = NullItem(Item=int_14)  # -> NullFlags, InvalidFlags, Description; disabled
ln_10 = Line(StartPoint=item_12, EndPoint=item_13)  # disabled
dispatch_39 = Dispatch(List=int_14, DispatchPattern=null_9.NullFlags)  # -> ListA, ListB; disabled
dispatch_40 = Dispatch(List=int_13, DispatchPattern=null_9.NullFlags)  # -> ListA, ListB; disabled
python_43 = PythonScript(points=python_30.points, lines=python_32.lines, start=dispatch_40.ListB, end=dispatch_39.ListB)  # -> out, polyline, sdist; disabled
# ---------- python_43: Python ----------
# ======== Graph related classes. ========
# `Node` and `Edge` do not keep topology data. They have a reference to the
# `Graph` they belong to.

import json
import rhinoscriptsyntax as rs


class Node:
    def __init__(self, name):
        self.name = name
        self.graph = None
        self.tag = None


class Edge:
    def __init__(self, weight):
        self.weight = weight
        self.graph = None
        self.tag = None


class Digraph:
    def __init__(self):
        self.nodes = {}
        self.edges = {}
        self.adjs = {}

    def add_node(self, node):
        node.graph = self
        self.nodes[node.name] = node
        self.adjs[node.name] = []

    def node(self, nname):
        return self.nodes.get(nname, None)

    def add_edge(self, edge, nname0, nname1):

        if nname0 not in self.nodes or nname1 not in self.nodes:
            return False

        edge.graph = self
        self.edges[(nname0, nname1)] = edge
        self.adjs[nname0].append(nname1)
        return True

    def edge(self, nname0, nname1):
        return self.edges.get((nname0, nname1), None)

    def weight(self, nname0, nname1):
        edge = self.edge(nname0, nname1)
        if edge is not None:
            return edge.weight
        else:
            return float('inf')

    def adj(self, nname):
        return self.adjs[nname]


# ======== Graph related functions. ========

def initialize(graph, sname, preds, sdist):
    for nname in graph.nodes.keys():
        preds[nname] = None
        sdist[nname] = float('inf')
    sdist[sname] = 0


def relax(graph, preds, sdist, nname0, nname1):
    weight = graph.weight(nname0, nname1)
    if sdist[nname1] > sdist[nname0] + weight:
        sdist[nname1] = sdist[nname0] + weight
        preds[nname1] = nname0


def bellman_ford(graph, sname):
    tree = None

    # Initialize.
    preds = {}
    sdists = {}
    initialize(graph, sname, preds, sdists)

    # Relax.
    for i in range(1, len(graph.nodes)):
        for nname0, nname1 in graph.edges.keys():
            relax(graph, preds, sdists, nname0, nname1)

    # Check for negative-weighted cycle.
    for nname0, nname1 in graph.edges.keys():
        weight = graph.weight(nname0, nname1)
        if sdists[nname1] > sdists[nname0] + weight:
            return None, None

    return preds, sdists


def mk_spath(sname, dname, preds, sdists):

    spath = [dname]
    print(preds)
    while spath[0] != sname:
        cur = spath[0]
        pred = preds[cur]
        spath.insert(0, pred)

    sdist = sdists[dname]

    return spath, sdist


def test():

    '''
    Example from Figure 24.4 in Introduction to Algorithm, Third Edition.
    '''

    node_s = Node('s')
    node_t = Node('t')
    node_x = Node('x')
    node_y = Node('y')
    node_z = Node('z')

    edge_st = Edge(6.0)
    edge_sy = Edge(7.0)
    edge_tx = Edge(5.0)
    edge_ty = Edge(8.0)
    edge_tz = Edge(-4.0)
    edge_xt = Edge(-2.0)
    edge_yx = Edge(-3.0)
    edge_yz = Edge(9.0)
    edge_zs = Edge(2.0)
    edge_zx = Edge(7.0)

    graph = Digraph()
    graph.add_node(node_s)
    graph.add_node(node_t)
    graph.add_node(node_x)
    graph.add_node(node_y)
    graph.add_node(node_z)
    graph.add_edge(edge_st, 's', 't')
    graph.add_edge(edge_sy, 's', 'y')
    graph.add_edge(edge_tx, 't', 'x')
    graph.add_edge(edge_ty, 't', 'y')
    graph.add_edge(edge_tz, 't', 'z')
    graph.add_edge(edge_xt, 'x', 't')
    graph.add_edge(edge_yx, 'y', 'x')
    graph.add_edge(edge_yz, 'y', 'z')
    graph.add_edge(edge_zs, 'z', 's')
    graph.add_edge(edge_zx, 'z', 'x')

    preds, sdists = bellman_ford(graph, 's')
    spath, sdist = mk_spath('s', 'y', preds, sdists)
    print(spath)
    print(sdist)


# ======== Translate from/to Lorenzo's data format. ========

# points: {'point_name': (x, y, z)}
# lines: [((x0, y0, z0), (x1, y1, z1), cost)]


def mk_graph_gh(points, lines):

    graph = Digraph()

    for name, pos in points.items():
        node = Node(name)
        node.tag = pos
        graph.add_node(node)

    point_rmap = {points[name]: name for name in points}

    for line in lines:

        nname0 = point_rmap[line[0]]
        nname1 = point_rmap[line[1]]

        edge0 = Edge(line[2])
        edge0.tag = line[:2]
        graph.add_edge(edge0, nname0, nname1)

        edge1 = Edge(line[2])
        edge1.tag = (line[1], line[0])
        graph.add_edge(edge1, nname1, nname0)

    return graph


def path_to_polyline(path, points):
    return [points[nname] for nname in path]


def round_pt(pt, place=8):
    return tuple([round(x, place) for x in pt])

if __name__ == '__main__':

    # test()

    # TODO
    # Inputs to be connected to other GH nodes.
    # Split this script to minimize re-evaluation.

    points = json.loads(points)
    points = {k: round_pt(v) for k, v in points.items()}
    lines = json.loads(lines)
    lines = [[round_pt(e0), round_pt(e1), cost] for e0, e1, cost in lines]

    sname = str(start)
    dname = str(end)

    graph = mk_graph_gh(points, lines)
    print(len(graph.nodes))
    print(len(graph.edges))
    preds, sdists = bellman_ford(graph, sname)
    spath, sdist = mk_spath(sname, dname, preds, sdists)

    polyline = path_to_polyline(spath, points)
    print(polyline)

    polyline = rs.AddPolyline(
        [rs.AddPoint(p) for p in polyline])
# ---------- end python_43 ----------
panel_91 = Panel(python_43.out)  # disabled
crv_62 = Curve(python_43.polyline)  # disabled
end_12 = EndPoints(Curve=crv_62)  # -> Start, End; disabled
move_19 = Move(Geometry=crv_62, Motion=Z_19)  # -> Geometry, Transform; disabled
move_20 = Move(Geometry=[end_12.Start, end_12.End], Motion=Z_18)  # -> Geometry, Transform; disabled
previewlw_27 = CustomPreviewLineweights(
    Geometry=move_19.Geometry,
    Shader={ambient=RGB(0, 0, 0), diffuse=RGB(255, 105, 180), emission=RGB(76, 32, 54), shine=0.5, specular=RGB(255, 255, 255), transparency=0},
    Thickness=number_slider_30)  # disabled
cloud = CloudDisplay(Points=move_20.Geometry, Colours=RGB(255, 20, 147), Size=2, SpriteType=0)  # disabled

# ---- group: journey cost
data_133 = Data(python_43.sdist)  # disabled

# ----
panel_92 = Panel(data_133)  # disabled

# ---- group: max
sort_20 = SortList(Keys=data)  # -> Keys, ValuesA
item_14 = ListItem(List=reverse(sort_20.Keys), Index=0, Wrap=True)

# ---- group: max / maxdeltaZ
data_134 = Data(item_14)

# ---- group: max (continued)
eval_3 = Evaluate(F="l*(1+(z/f))", z=data_134, f=floor_height_or_ave_fl_fl_height, l=max_feet_distance)
eval_4 = Evaluate(F=panel_50, z=data_134, h=data_134, l=max_feet_distance, f=number_slider_4)

# ---- group: max / cost
data_135 = Data(eval_4)

# ---- group: max (continued)
multiplication_18 = Multiplication(A=data_135, B=Slider(1, range=0.1..2))

# ----
panel_94 = Panel(multiplication_18)

# ---- group: max cost
data_136 = Data(multiplication_18)

# ----
panel_95 = Panel(data_136)
multiplication_19 = Multiplication(A=data_136, B=Slider(0.02, range=0..0.2))

# ---- group: normalize cost / max cost
data_137 = Data(data_136)

data_138 = Data(data_136)

data_139 = Data(data_136)

data_140 = Data(data_136)

data_141 = Data(data_136)

data_142 = Data(data_136)

data_143 = Data(data_136)

# ---- group: normalize cost
# max cost: is max L possible (max search) combined with highest z factor (mazZ/current F)
bnd_10 = Bounds(Numbers=data_96)
dedomain_10 = DeconstructDomain(Domain=bnd_10)  # -> Start, End
dom_2 = ConstructDomain(DomainStart=data_137, DomainEnd=data_43)
remap = RemapNumbers(Value=data_96, Source=dom_2, Target=Domain(0, 10))  # -> Mapped, Clipped

# ---- group: normalize cost / Cost
data_144 = Data(remap.Mapped)

# ---- group: normalize cost
# max cost: is max L possible (max search) combined with highest z factor (mazZ/current F)
bnd_11 = Bounds(Numbers=data_97)
dedomain_11 = DeconstructDomain(Domain=bnd_11)  # -> Start, End
dom_3 = ConstructDomain(DomainStart=data_138, DomainEnd=data_44)
remap_2 = RemapNumbers(Value=data_97, Source=dom_3, Target=Domain(0, 10))  # -> Mapped, Clipped

# ---- group: normalize cost / Cost
data_145 = Data(remap_2.Mapped)

# ---- group: normalize cost
# max cost: is max L possible (max search) combined with highest z factor (mazZ/current F)
bnd_12 = Bounds(Numbers=data_105)
dedomain_12 = DeconstructDomain(Domain=bnd_12)  # -> Start, End
dom_4 = ConstructDomain(DomainStart=data_139, DomainEnd=data_45)
remap_3 = RemapNumbers(Value=data_105, Source=dom_4, Target=Domain(0, 10))  # -> Mapped, Clipped

# ---- group: normalize cost / Cost
data_146 = Data(remap_3.Mapped)

# ---- group: normalize cost
# max cost: is max L possible (max search) combined with highest z factor (mazZ/current F)
bnd_13 = Bounds(Numbers=data_128)
dedomain_13 = DeconstructDomain(Domain=bnd_13)  # -> Start, End
dom_5 = ConstructDomain(DomainStart=data_140, DomainEnd=data_46)
remap_4 = RemapNumbers(Value=data_128, Source=dom_5, Target=Domain(0, 10))  # -> Mapped, Clipped

# ---- group: normalize cost / Cost
data_147 = Data(remap_4.Mapped)

# ---- group: normalize cost
# max cost: is max L possible (max search) combined with highest z factor (mazZ/current F)
bnd_14 = Bounds(Numbers=partition_11)
dedomain_14 = DeconstructDomain(Domain=bnd_14)  # -> Start, End
dom_6 = ConstructDomain(DomainStart=data_141, DomainEnd=data_47)
remap_5 = RemapNumbers(Value=partition_11, Source=dom_6, Target=Domain(0, 10))  # -> Mapped, Clipped

# ---- group: normalize cost / Cost
data_148 = Data(remap_5.Mapped)

# ---- group: normalize cost
# max cost: is max L possible (max search) combined with highest z factor (mazZ/current F)
bnd_15 = Bounds(Numbers=partition_9)
dedomain_15 = DeconstructDomain(Domain=bnd_15)  # -> Start, End
dom_7 = ConstructDomain(DomainStart=data_142, DomainEnd=data_48)
remap_6 = RemapNumbers(Value=partition_9, Source=dom_7, Target=Domain(0, 10))  # -> Mapped, Clipped

# ---- group: normalize cost / Cost
data_149 = Data(remap_6.Mapped)

# ---- group: normalize cost
# max cost: is max L possible (max search) combined with highest z factor (mazZ/current F)
dom_8 = ConstructDomain(DomainStart=data_136, DomainEnd=data_42)
remap_7 = RemapNumbers(Value=data_119, Source=dom_8, Target=dom)  # -> Mapped, Clipped

# ---- group: normalize cost / Cost
data_150 = Data(remap_7.Mapped)

# ---- group: normalize cost
# max cost: is max L possible (max search) combined with highest z factor (mazZ/current F)
bnd_16 = Bounds(Numbers=data_126)
dedomain_16 = DeconstructDomain(Domain=bnd_16)  # -> Start, End
dom_9 = ConstructDomain(DomainStart=data_143, DomainEnd=data_49)
remap_8 = RemapNumbers(Value=data_126, Source=dom_9, Target=Domain(0, 10))  # -> Mapped, Clipped

# ---- group: normalize cost / Cost
data_151 = Data(remap_8.Mapped)

# ---- group: normalize cost (continued)
python_44 = PythonScript(x=data_144)  # -> out, a; inputs x: list
# ---------- python_44: Python ----------
for value in x:
    if value < 0:
        i = x.index(value)
        del x[i]

a = x
# ---------- end python_44 ----------
min = Minimum(A=data_144, B="10")
max = Maximum(A=min, B="0")

# ---- group: normalize cost / normalized cost (0,10)
data_152 = Data(python_44.a)

# ---- group: normalized cost (0,10)
data_153 = Data(max)

# ---- group: normalize cost / normalized cost (0,10)
data_154 = Data(max)

# ---- group: normalize cost (continued)
bnd_17 = Bounds(Numbers=data_154)

# ----
avr_12 = Average(Input=data_154)
panel_96 = Panel(bnd_17)

# ---- group: ADJ empl - Division SCORE
data_155 = Data(avr_12)

# ----
panel_97 = Panel(data_155)

# ---- group: normalize cost (continued)
python_45 = PythonScript(x=data_150)  # -> out, a; inputs x: list
# ---------- python_45: Python ----------
a = []
for value in x:
    if value > 0:
        a.append(value)
# ---------- end python_45 ----------
min_2 = Minimum(A=data_150, B="10")
max_2 = Maximum(A=min_2, B="0")

# ---- group: normalize cost / normalized cost (0,10)
data_156 = Data(python_45.a)

data_157 = Data(max_2)

# ---- group: normalized cost (0,10)
data_158 = Data(max_2)

# ---- group: normalize cost (continued)
avr_13 = Average(Input=data_157)
bnd_18 = Bounds(Numbers=data_157)

# ----
panel_98 = Panel(bnd_18)
panel_99 = Panel(data_157)

# ---- group: ADJ empl - neighbour employees SCORE
data_159 = Data(avr_13)

# ----
panel_100 = Panel(data_159)

# ---- group: normalize cost (continued)
python_46 = PythonScript(x=data_146)  # -> out, a; inputs x: list; same code as python_44
min_3 = Minimum(A=data_146, B="10")
max_3 = Maximum(A=min_3, B="0")

# ---- group: normalize cost / normalized cost (0,10)
data_160 = Data(python_46.a)

data_161 = Data(max_3)

# ---- group: normalize cost (continued)
avr_14 = Average(Input=data_161)
bnd_19 = Bounds(Numbers=data_161)

# ----
panel_101 = Panel(bnd_19)

# ---- group: ADJ empl - managers SCORE
data_162 = Data(avr_14)

# ----
panel_102 = Panel(data_162)

# ---- group: normalize cost (continued)
python_47 = PythonScript(x=data_147)  # -> out, a; inputs x: list; same code as python_44
min_4 = Minimum(A=data_147, B="10")
max_4 = Maximum(A=min_4, B="0")

# ---- group: normalize cost / normalized cost (0,10)
data_163 = Data(python_47.a)

data_164 = Data(max_4)

# ---- group: normalize cost (continued)
avr_15 = Average(Input=data_164)
bnd_20 = Bounds(Numbers=data_164)

# ---- group: ADJ empl - managers SCORE
data_165 = Data(avr_15)

# ----
panel_103 = Panel(bnd_20)
panel_104 = Panel(data_165)
avr_16 = Average(Input=flatten(data_165))
item_15 = ListItem(List=data_165, Index=0, Wrap=True)

# ---- group: normalize cost (continued)
python_48 = PythonScript(x=data_145)  # -> out, a; inputs x: list; same code as python_44
min_5 = Minimum(A=data_145, B="10")
max_5 = Maximum(A=min_5, B="0")

# ---- group: normalize cost / normalized cost (0,10)
data_166 = Data(python_48.a)

data_167 = Data(max_5)

# ---- group: normalized cost (0,10)
data_168 = Data(max_5)

# ---- group: normalize cost (continued)
bnd_21 = Bounds(Numbers=data_167)

# ----
panel_105 = Panel(bnd_21)
avr_17 = Average(Input=data_167)

# ---- group: ADJ empl - Amenity SCORE
data_169 = Data(avr_17)

# ----
panel_106 = Panel(data_169)
avr_18 = Average(Input=[data_169, data_155, data_159, data_162])
merge_10 = Merge(Data1=data_167, Data2=data_154, Data3=data_157, Data4=data_161)
avr_19 = Average(Input=merge_10)
panel_107 = Panel(avr_18)
panel_108 = Panel(avr_19)

# ---- group: normalize cost (continued)
python_49 = PythonScript(x=data_149)  # -> out, a; inputs x: list; same code as python_44
min_6 = Minimum(A=data_149, B="10")
max_6 = Maximum(A=min_6, B="0")

# ---- group: normalize cost / normalized cost (0,10)
data_170 = Data(python_49.a)

data_171 = Data(max_6)

# ---- group: normalize cost (continued)
bnd_22 = Bounds(Numbers=data_171)

# ----
avr_20 = Average(Input=data_171)
panel_109 = Panel(bnd_22)
panel_110 = Panel(avr_20)
avr_21 = Average(Input=flatten(avr_20))

# ---- group: normalize cost (continued)
python_50 = PythonScript(x=data_148)  # -> out, a; inputs x: list; same code as python_44
min_7 = Minimum(A=data_148, B="10")
max_7 = Maximum(A=min_7, B="0")

# ---- group: normalize cost / normalized cost (0,10)
data_172 = Data(python_50.a)

data_173 = Data(max_7)

# ---- group: normalize cost (continued)
avr_22 = Average(Input=data_173)
bnd_23 = Bounds(Numbers=data_173)

# ---- group: ADJ empl - managers SCORE
data_174 = Data(avr_22)

# ----
panel_111 = Panel(bnd_23)
panel_112 = Panel(data_174)
avr_23 = Average(Input=flatten(data_174))
merge_11 = Merge(Data1=data_165, Data2=data_174, Data3=avr_20)
panel_113 = Panel(merge_11)
avr_24 = Average(Input=merge_11)
panel_114 = Panel(avr_24)

join_2 = JoinCurves(Curves=crv_52, Preserve=False)
python_51 = PythonScript(x=join_2)  # -> out, result, pts; inputs x: list of Curve
# ---------- python_51: Python ----------
import rhinoscriptsyntax as rs

result = []

for curveA in x:
    for curveB in x:
        if curveA != curveB:

            val= rs.CurveCurveIntersection(curveA, curveB)
            if val:
                result.append(val)
                
                

print len(result)

pts = []
for val in result:
    pt= rs.AddPoint( val[0][1] )
    pts.append(pt)
# ---------- end python_51 ----------
rdpoints_4 = RemoveDuplicatePointsKaramba(Point=python_51.pts, LDist=0.005)  # -> OutPoint, Info, Indexes
lng_34 = ListLength(List=rdpoints_4.OutPoint)

# ---- group: n Intersections
data_175 = Data(lng_34)

# ----
panel_115 = Panel(data_175)

crv_63 = Curve([<curve referenced from the Rhino model> x6])
end_13 = EndPoints(Curve=join_2)  # -> Start, End
pt_76 = Point([end_13.Start, end_13.End])
dist = Distance(PointA=graft(pt_76), PointB=pt_76)
sort_21 = SortList(Keys=dist)  # -> Keys, ValuesA
item_16 = ListItem(List=sort_21.Keys, Index="1", Wrap=True)
panel_116 = Panel(item_16)
larger_10 = LargerThan(FirstNumber=item_16, SecondNumber="0")  # -> LargerThan, OrEqualTo
dispatch_41 = Dispatch(List=pt_76, DispatchPattern=flatten(larger_10.LargerThan))  # -> ListA, ListB
pt_77 = Point(dispatch_41.ListA)
lng_35 = ListLength(List=pt_77)

# ---- group: n dead ends
data_176 = Data(lng_35)

# ----
panel_117 = Panel(data_176)

# ---- group: normalize cost (continued)
python_52 = PythonScript(x=data_151)  # -> out, a; inputs x: list; same code as python_44
min_8 = Minimum(A=data_151, B="10")
max_8 = Maximum(A=min_8, B="0")

# ---- group: normalize cost / normalized cost (0,10)
data_177 = Data(python_52.a)

data_178 = Data(max_8)

# ----
panel_118 = Panel(data_178)

# ---- group: normalize cost (continued)
bnd_24 = Bounds(Numbers=data_178)

# ----
panel_119 = Panel(bnd_24)
avr_25 = Average(Input=data_178)

# ---- group: ADJ empl - Amenity SCORE
data_179 = Data(avr_25)

# ----
panel_120 = Panel(data_179)

# ==== cluster Cluster
pt = ClusterInput()
pt_2 = Point(pt)
pdecon = Deconstruct(Point=pt_2)  # -> XComponent, YComponent, ZComponent
sort = SortList(Keys=pdecon.ZComponent)  # -> Keys, ValuesA
dcon = DeleteConsecutive(Set=sort.Keys, Wrap=False)  # -> Set, Count
equals = Equality(FirstNumber=pdecon.ZComponent, SecondNumber=graft(dcon.Set))  # -> Equality, Inequality
dispatch = Dispatch(List=pt_2, DispatchPattern=equals.Equality)  # -> ListA, ListB
pt_3 = Point(simplify(dispatch.ListA))
bool = Boolean(equals.Equality)
pt_4 = ClusterOutput(pt_3)
bool_2 = ClusterOutput(bool)
